# Dynamo graph 191203 - SetAllLineStyles.dyn (Dynamo 2.12.1.8246)

# group: Selects All lines of Nominated type
categories = Categories("OST_FoodServiceEquipmentTags")
all_elements_of_category = ElementsOfCategory(Category=categories)
code_block = CodeBlock { "Line Style"; }
getParameterValueByName = Element.GetParameterValueByName(element=all_elements_of_category, parameterName=code_block)
name = Element.Name(element=getParameterValueByName)
code_block_2 = CodeBlock { "1HATCH"; }
boolean = BoolSelector(true)
contains = String.Contains(string=name, searchFor=code_block_2, ignoreCase=boolean)
filterByBoolMask = List.FilterByBoolMask(list=all_elements_of_category, mask=contains)

# group: Select line to change to
select_model_element = DSModelElementSelection()  # 1 picked in the model
code_block_3 = CodeBlock { "Line Style"; }
getParameterValueByName_2 = Element.GetParameterValueByName(element=select_model_element, parameterName=code_block_3)
code_block_4 = CodeBlock { 0; }
getItemAtIndex = List.GetItemAtIndex(list=getParameterValueByName_2, index=code_block_4)
name_2 = Element.Name(element=getItemAtIndex)

# group: Set Linetype Parameter
code_block_5 = CodeBlock { "Line Style"; }
setParameterByName = Element.SetParameterByName(element=filterByBoolMask.in, parameterName=code_block_5, value=getItemAtIndex)
select_model_element_2 = DSModelElementSelection()  # 1 picked in the model
