# Dynamo graph 20230427_DYN-MEP-DRG-0001_Create Sheet with Views from Space_v2.dyn (Dynamo 2.12.1.8246)
# packages: Data-Shapes 2022.2.105, Genius Loci 2023.2.21, archi-lab.net 2023.213.1722, Clockwork for Dynamo 2.x 2.4.0, Rhythm 2023.2.2, spring nodes 210.1.1

# group: Select all Spaces in the model
code_block = CodeBlock { "Select Space"; }
categories = Categories("OST_MEPSpaces")
all_elements_of_category = ElementsOfCategory(Category=categories)
name = Element.Name(element=all_elements_of_category)
# note: Custom Node: Data-Shapesv.2022.2.105
listview_data = Custom[Listview Data](InputName=code_block, Keys=name, Values=all_elements_of_category)  # package Data-Shapes

# group: INPUT: Select Space
code_block_2 = CodeBlock { true; }
code_block_3 = CodeBlock { 800; }
code_block_4 = CodeBlock { 200; }
# note: Custom Node: Data-Shapesv.2022.2.105
multipleinputform = Custom[MultipleInputForm ++](Inputs=listview_data, Toggle=code_block_2, Width_optional=code_block_3, LabelWidth_optional=code_block_4)  # package Data-Shapes

# group: INPUT: Sheet Name
code_block_5 = CodeBlock { "Specify new Sheet Number (MUST be unique!)"; }
string = StringInput("Example - Test01")
# note: Custom Node: Data-Shapesv.2022.2.105
textbox_data = Custom[TextBox Data](InputName=code_block_5, DefaultText=string)  # package Data-Shapes
code_block_6 = CodeBlock { 100; }
code_block_7 = CodeBlock { 140; }
multipleinputform_2 = Custom[MultipleInputForm ++](Inputs=textbox_data, Toggle=multipleinputform.Was_Run, Width_optional=code_block_6, LabelWidth_optional=code_block_7)

# group: Retreive Name as string for naming views
number = Space.Number(space=multipleinputform.User_Inputs)
flatten = List.Flatten(list=number)
code_block_8 = CodeBlock { " "; }
name_2 = Space.Name(space=multipleinputform.User_Inputs)
flatten_2 = List.Flatten(list=name_2)
code_block_9 = CodeBlock(lst=flatten, x=code_block_8, suff=flatten_2) { lst+x+suff; }
flatten_3 = List.Flatten(list=multipleinputform.User_Inputs)
count = List.Count(list=flatten_3)
ofRepeatedItem = List.OfRepeatedItem(item=multipleinputform_2.User_Inputs, amount=count)
code_block_10 = CodeBlock(x=count) { 1..#x..1; }
code_block_11 = CodeBlock(x=count, lst=ofRepeatedItem, suff=code_block_10) { x>1?lst+suff:lst; }
code_block_12 = CodeBlock { "70 - SH - SV"; }
code_block_13 = CodeBlock { " - "; }
code_block_14 = CodeBlock(a=code_block_12, b=code_block_13, c=code_block_9) { a+b+c; }

flatten_4 = List.Flatten(list=code_block_11)
# note: Custom Node: Rhythmv.2023.2.2
titleblock_types = TitleblockTypes("PLD_A1_H_Titleblock_EDA-TP:FOR INFORMATION")

# group: Get a Bounding Box +300mm around the Space
flatten_5 = List.Flatten(list=multipleinputform.User_Inputs)
boundingBox = Element.BoundingBox(element=flatten_5)
maxPoint = BoundingBox.MaxPoint(boundingBox=boundingBox)
offset = DoubleInput(300)
translate = Geometry.Translate(geometry=maxPoint, xTranslation=offset, yTranslation=offset, zTranslation=offset)
minPoint = BoundingBox.MinPoint(boundingBox=boundingBox)
code_block_15 = CodeBlock(x=offset) { -x; }
translate_2 = Geometry.Translate(geometry=minPoint, xTranslation=code_block_15, yTranslation=code_block_15, zTranslation=code_block_15)

# group: Get geometry (mid point of bb, max point, min point) to use for creating Sections
X = Point.X(point=translate)
X_2 = Point.X(point=translate_2)
code_block_16 = CodeBlock(x=X, y=X_2) { (x+y)/2; }
Y = Point.Y(point=translate)
Y_2 = Point.Y(point=translate_2)
code_block_17 = CodeBlock(x=Y, y=Y_2) { (x+y)/2; }
Z = Point.Z(point=translate_2)
byCoordinates = Point.ByCoordinates(x=code_block_16, y=code_block_17, z=Z)
XAxis = Vector.XAxis()
ZAxis = Vector.ZAxis()
YAxis = Vector.YAxis()
byOriginVectors = CoordinateSystem.ByOriginVectors(origin=byCoordinates, xAxis=XAxis, yAxis=ZAxis, zAxis=YAxis)
code_block_18 = CodeBlock(x=X, y=X_2) { (x-y)/2; -(x-y)/2; }
code_block_19 = CodeBlock { -500; }
byCoordinates_2 = Point.ByCoordinates(x=code_block_18.out1, z=code_block_19)
Z_2 = Point.Z(point=translate)
code_block_20 = CodeBlock(x=Z_2, y=Z) { (x-y); }
code_block_21 = CodeBlock(x=Y, y=Y_2) { (x-y)/2; -(x-y)/2; }
byCoordinates_3 = Point.ByCoordinates(x=code_block_18.out0, y=code_block_20, z=code_block_21.out0)
byOriginVectors_2 = CoordinateSystem.ByOriginVectors(origin=byCoordinates, xAxis=YAxis, yAxis=ZAxis, zAxis=XAxis)
byCoordinates_4 = Point.ByCoordinates(x=code_block_21.out1, z=code_block_19)
byCoordinates_5 = Point.ByCoordinates(x=code_block_21.out0, y=code_block_20, z=code_block_18.out0)

# group: Create Sections
byCoordinateSystemMinPointMaxPoint = SectionView.ByCoordinateSystemMinPointMaxPoint(cs=byOriginVectors, minPoint=byCoordinates_2, maxPoint=byCoordinates_3)
byCoordinateSystemMinPointMaxPoint_2 = SectionView.ByCoordinateSystemMinPointMaxPoint(cs=byOriginVectors_2, minPoint=byCoordinates_4, maxPoint=byCoordinates_5)

# group: Get Naming for 3D and Sections
code_block_22 = CodeBlock { "70 - SH - SV"; }
code_block_23 = CodeBlock { " - "; }
code_block_24 = CodeBlock { "SECTION 1"; }
code_block_25 = CodeBlock(a=code_block_22, b=code_block_23, c=code_block_9, d=code_block_23, e=code_block_24) { a+b+c+d+e; }
code_block_26 = CodeBlock { "SECTION 2"; }
code_block_27 = CodeBlock(a=code_block_22, b=code_block_23, c=code_block_9, d=code_block_23, e=code_block_26) { a+b+c+d+e; }
code_block_28 = CodeBlock { "3D"; }
code_block_29 = CodeBlock(a=code_block_22, b=code_block_23, c=code_block_9, d=code_block_23, e=code_block_28) { a+b+c+d+e; }

# group: Rename Views
code_block_30 = CodeBlock { "View Name"; }
setParameterByName = Element.SetParameterByName(element=byCoordinateSystemMinPointMaxPoint, parameterName=code_block_30, value=code_block_25)
setParameterByName_2 = Element.SetParameterByName(element=byCoordinateSystemMinPointMaxPoint_2, parameterName=code_block_30, value=code_block_27)

# group: Create Floor Plan
code_block_31 = CodeBlock { true; }
python_script = Python(IN[0]=flatten_5, IN[1]=code_block_14, IN[2]=offset, IN[3]=code_block_31)  # IronPython2
# ---------- python_script.python (118 lines) ----------
# Copyright(c) 2015, Konrad K Sobon
# @arch_laboratory, http://archi-lab.net

import clr
clr.AddReference('ProtoGeometry')
from Autodesk.DesignScript.Geometry import *

# Import Element wrapper extension methods
clr.AddReference("RevitNodes")
import Revit
clr.ImportExtensions(Revit.Elements)

# Import geometry conversion extension methods
clr.ImportExtensions(Revit.GeometryConversion)

# Import DocumentManager and TransactionManager
clr.AddReference("RevitServices")
import RevitServices
from RevitServices.Persistence import DocumentManager
from RevitServices.Transactions import TransactionManager
doc = DocumentManager.Instance.CurrentDBDocument

# Import RevitAPI
clr.AddReference("RevitAPI")
import Autodesk
from Autodesk.Revit.DB import *

import System
from System import Array
from System.Collections.Generic import *

import sys
pyt_path = r'C:\Program Files (x86)\IronPython 2.7\Lib'
sys.path.append(pyt_path)

#The inputs to this node will be stored as a list in the IN variable.
dataEnteringNode = IN

if isinstance(IN[0], list):
	rooms = UnwrapElement(IN[0])
else:
	rooms = [UnwrapElement(IN[0])]
if isinstance(IN[1], list):
	namePrefix = UnwrapElement(IN[1])
else:
	namePrefix = [UnwrapElement(IN[1])]
bboxOffset = IN[2]
runMe = IN[3]

def OffsetBBox(bbox, offset):
	bboxMinX = bbox.Min.X - offset
	bboxMinY = bbox.Min.Y - offset
	bboxMinZ = bbox.Min.Z - offset
	bboxMaxX = bbox.Max.X + offset
	bboxMaxY = bbox.Max.Y + offset
	bboxMaxZ = bbox.Max.Z + offset
	newBbox = BoundingBoxXYZ()
	newBbox.Min = XYZ(bboxMinX, bboxMinY, bboxMinZ)
	newBbox.Max = XYZ(bboxMaxX, bboxMaxY, bboxMaxZ)
	return newBbox

try:
	errorReport = None
	if runMe:
		viewTypes = FilteredElementCollector(doc).OfClass(ViewFamilyType)
		for i in viewTypes:
			if i.ViewFamily == ViewFamily.FloorPlan:
				viewTypeId = i.Id
				break
			else:
				continue
		
		existingPlans = FilteredElementCollector(doc).OfClass(View).ToElements()
		
		existingPlanNames, existingPlanElements = [], []
		for i in existingPlans:
			if not i.IsTemplate:
				if i.ViewType == ViewType.FloorPlan:
					existingPlanNames.append(i.ToDSType(True).Name)
					existingPlanElements.append(i)
					
		# Start Transaction
		TransactionManager.Instance.EnsureInTransaction(doc)
		
		floorPlans = []
		for i, j in zip(rooms, namePrefix):
			levelId = i.LevelId
			bbox = i.BoundingBox[doc.ActiveView]
			newBbox = OffsetBBox(bbox, bboxOffset)
			viewName = j.ToString()
			if viewName in existingPlanNames:
				view = existingPlanElements[existingPlanNames.index(viewName)]
				view.CropBox = newBbox
				view.CropBoxActive = True
				view.CropBoxVisible = False
				floorPlans.append(view)
			else:
				newView = ViewPlan.Create(doc, viewTypeId, levelId)
				newView.Name = viewName
				newView.CropBox = newBbox
				newView.CropBoxActive = True
				newView.CropBoxVisible = False
				floorPlans.append(newView)
	
		# End Transaction
		TransactionManager.Instance.TransactionTaskDone()
	else:
		errorReport = "Run Me set to False"
except:
	# if error accurs anywhere in the process catch it
	import traceback
	errorReport = traceback.format_exc()

#Assign your output to the OUT variable
if errorReport == None:
	OUT = floorPlans
else:
	OUT = errorReport
# ----------------------------------------

# group: Set Crop Boundaries for Floor Plan
# note: Custom Node: Clockwork
boundaries = Custom[Room.Boundaries](room=flatten_5)  # package Clockwork for Dynamo 2.x
byJoinedCurves = PolyCurve.ByJoinedCurves(curves=boundaries.curves)
offset_2 = Curve.Offset(curve=byJoinedCurves, distance=offset)
curves = PolyCurve.Curves(polyCurve=offset_2)
# note: Custom Node: archilab
setCropBoxByCurves = archilab.Revit.Views.Views.SetCropBoxByCurves(view=python_script, curves=curves)

# group: Create 3D View
byCorners = BoundingBox.ByCorners(min=translate_2, max=translate)
# note: Custom Node: GeniusLociv.2023.2.21
n3dview_by_boundingbox = Custom[3DView by BoundingBox](boundingBox=byCorners, viewName=code_block_29)  # package Genius Loci

boolean = BoolSelector(true)
setCropBoxVisible = View.SetCropBoxVisible(view=n3dview_by_boundingbox, isVisible=boolean)

# group: Set View Templates
# note: Custom Node: archilab
view_templates = ViewTemplatesUi("70 - Sh - SV - PLANTROOMS AND RISERS - Section")
setViewTemplate = archilab.Revit.Views.Views.SetViewTemplate(view=setParameterByName, viewTemplate=view_templates)
setViewTemplate_2 = archilab.Revit.Views.Views.SetViewTemplate(view=setParameterByName_2, viewTemplate=view_templates)
view_templates_2 = ViewTemplatesUi("70 - Sh - SV - PLANTROOMS AND RISERS - Floor Plan")
setViewTemplate_3 = archilab.Revit.Views.Views.SetViewTemplate(view=setCropBoxByCurves, viewTemplate=view_templates_2)
# note: Custom Node: spring nodesv.210.1.1
ꟿ_collect_view3dtemplates = Custom[ꟿ Collect.View3DTemplates]()  # package spring nodes; Gets all 3d view templates and returns them to Dynamo as generic Elements
name_3 = Element.Name(element=ꟿ_collect_view3dtemplates)
code_block_32 = CodeBlock { "70 - Sh - SV - PLANTROOMS AND RISERS - 3D View"; }
indexOf = List.IndexOf(list=name_3, element=code_block_32)
getItemAtIndex = List.GetItemAtIndex(list=ꟿ_collect_view3dtemplates, index=indexOf)
# note: Custom Node: GeniusLociv.2023.2.21
view_applyviewtemplate = Custom[View ApplyViewTemplate](view=setCropBoxVisible, viewTemplate=getItemAtIndex)  # package Genius Loci

# group: Gather Views
list_create = List.Create(item0=setViewTemplate, item1=setViewTemplate_2, item2=setViewTemplate_3, item3=view_applyviewtemplate)
transpose = List.Transpose(lists=list_create)

code_block_33 = CodeBlock { "Annotation Crop"; }
code_block_34 = CodeBlock { true; }
setParameterByName_3 = Element.SetParameterByName(element=transpose, parameterName=code_block_33, value=code_block_34)

# group: Set up grid for placing Views
code_block_35 = CodeBlock { 300; 600; 230; 460; }
byCoordinates_6 = Point.ByCoordinates(x=code_block_35.out0, y=code_block_35.out2)
byCoordinates_7 = Point.ByCoordinates(x=code_block_35.out1, y=code_block_35.out2)
byCoordinates_8 = Point.ByCoordinates(x=code_block_35.out0, y=code_block_35.out3)
byCoordinates_9 = Point.ByCoordinates(x=code_block_35.out1, y=code_block_35.out3)
list_create_2 = List.Create(item0=byCoordinates_6, item1=byCoordinates_7, item2=byCoordinates_8, item3=byCoordinates_9)

# group: Place Views on Sheet
byNameNumberTitleBlockViewsAndLocations = Sheet.ByNameNumberTitleBlockViewsAndLocations(sheetName=code_block_9, sheetNumber=flatten_4, titleBlockFamilyType=titleblock_types, views=setParameterByName_3, locations=list_create_2)

# group: Set folder/subfolder for sheet
code_block_36 = CodeBlock { "tbDetail1"; }
code_block_37 = CodeBlock { "MULTI-DISCIPLINE SERVICES"; }
setParameterByName_4 = Element.SetParameterByName(element=byNameNumberTitleBlockViewsAndLocations, parameterName=code_block_36, value=code_block_37)
code_block_38 = CodeBlock { "tbDetail2"; }
code_block_39 = CodeBlock { "PLANTROOMS AND RISERS"; }
setParameterByName_5 = Element.SetParameterByName(element=byNameNumberTitleBlockViewsAndLocations, parameterName=code_block_38, value=code_block_39)
code_block_40 = CodeBlock { "-To Be Issued"; }
code_block_41 = CodeBlock { true; }
setParameterByName_6 = Element.SetParameterByName(element=byNameNumberTitleBlockViewsAndLocations, parameterName=code_block_40, value=code_block_41)
