# Dynamo graph 210423 - Adjust All View templates.dyn (Dynamo 2.12.1.8246)

# group: S1D46 - Modify plan and RCP view templates to hidel space separation lines
element_types = ElementTypes("ViewPlan")
all_elements_of_type = ElementsOfType(element_type=element_types)
categories = Categories("OST_MEPSpaceSeparationLines")
byProperties = Revit.Filter.OverrideGraphicSettings.ByProperties()
boolean = BoolSelector(true)
setCategoryOverrides = View.SetCategoryOverrides(view=all_elements_of_type, category=categories, overrides=byProperties, hide=boolean)
code_block = CodeBlock { "ViewPlan"; "Lines - <Space Separation>"; }
