# Dynamo graph 210511 - Edit Parameter.dyn (Dynamo 2.6.1.8786)
# packages: BumbleBee 2020.2.1, Clockwork for Dynamo 2.x 2.3.0, archi-lab.net 2021.25.2621

# group: Replace text segment in tag
select_model_elements = DSModelElementsSelection()  # 3 picked in the model; frozen
code_block = CodeBlock { "@Unit Reference Instance"; "MECH"; "ADMIN"; }
getParameterValueByName = Element.GetParameterValueByName(element=select_model_elements, parameterName=code_block.out0)
watch = Watch(getParameterValueByName)
replace = String.Replace(str=watch, searchFor=code_block.out1, replaceWith=code_block.out2)
watch_2 = Watch(replace)
toUpper = String.ToUpper(str=watch_2)
setParameterByName = Element.SetParameterByName(element=select_model_elements, parameterName=code_block.out0, value=toUpper)

# group: Replace level and room name
select_model_elements_2 = DSModelElementsSelection()  # 1 picked in the model
code_block_2 = CodeBlock { "@Unit Reference Instance"; "Room Name"; "ADMIN"; "Identity_Level"; "04N"; }
getParameterValueByName_2 = Element.GetParameterValueByName(element=select_model_elements_2, parameterName=code_block_2.out1)  # frozen
watch_3 = Watch(getParameterValueByName_2)
setParameterByName_2 = Element.SetParameterByName(element=select_model_elements_2, parameterName=code_block_2.out0, value=watch_3)  # frozen
setParameterByName_3 = Element.SetParameterByName(element=select_model_elements_2, parameterName=code_block_2.out3, value=code_block_2.out4)

# group: Insert Element ID
select_model_elements_3 = DSModelElementsSelection()  # 4 picked in the model; frozen
code_block_3 = CodeBlock { "@Unit Reference Instance"; "Room Name"; "ADMIN"; "Identity_Element ID"; "Level 1"; }
id = Element.Id(element=select_model_elements_3)
watch_4 = Watch(id)
string_from_object = FromObject(obj=watch_4)
setParameterByName_4 = Element.SetParameterByName(element=select_model_elements_3, parameterName=code_block_3.out3, value=string_from_object)

# group: Replace level
select_model_elements_4 = DSModelElementsSelection()  # 81 picked in the model; frozen
code_block_4 = CodeBlock { "@Unit Reference Instance"; "Room Name"; "ADMIN"; "Identity_Level"; "Level 1"; }
setParameterByName_5 = Element.SetParameterByName(element=select_model_elements_4, parameterName=code_block_4.out3, value=code_block_4.out4)

# group: Replace ACCU segment
select_model_elements_5 = DSModelElementsSelection()  # 6 picked in the model
code_block_5 = CodeBlock { "@Unit Reference Instance"; "-FODT"; "-DT"; "AHU"; "AHHU"; }
getParameterValueByName_3 = Element.GetParameterValueByName(element=select_model_elements_5, parameterName=code_block_5.out0)
watch_5 = Watch(getParameterValueByName_3)
replace_2 = String.Replace(str=watch_5, searchFor=code_block_5.out3, replaceWith=code_block_5.out4)
watch_6 = Watch(replace_2)
toUpper_2 = String.ToUpper(str=watch_6)
setParameterByName_6 = Element.SetParameterByName(element=select_model_elements_5, parameterName=code_block_5.out0, value=toUpper_2)  # frozen

file_path = Filename("..\..\OneDrive - Arup\279080 - MSFT SYD04 Lane Cove\ElementTagAdjust-VAB.xlsx")  # frozen
boolean = BoolSelector(true)
boolean_2 = BoolSelector(false)
code_block_6 = CodeBlock { "@Unit Reference Instance"; "d6"; "Sheet1"; "f6"; "AHHU"; }  # frozen
getParameterValueByName_4 = Element.GetParameterValueByName(element=select_model_elements_5, parameterName=code_block_6.out0)
bb_data = Custom[BB Data](sheetName=code_block_6.out2, origin=code_block_6.out3, data=getParameterValueByName_4)  # package BumbleBee; This node is a building block for different modes of writing to Excel files. You can combines this node into a list to write to multiple sheets or use just one to write to a single sheet.
write_excel = Custom[Write Excel](filePath=file_path, runIt=boolean, byColumn=boolean_2, BBData=bb_data)  # package BumbleBee; This node will write data to Excel file and based on how your BBData nodes are structured it will either override the exsting file, create a new one and write a single worksheet or write multiple worksheets.
categories = Categories("OST_MechanicalEquipment")  # frozen
all_elements_of_category = ElementsOfCategory(Category=categories)

# group: Get all detail item elements
categories_2 = Categories("OST_DetailComponents")  # frozen
all_elements_of_category_2 = ElementsOfCategory(Category=categories_2)
code_block_7 = CodeBlock { "@Unit Reference Instance"; "North Building"; "Supply Air"; "Room Name"; 1; "_Room"; }

# group: All in North building
getParameterValueByName_5 = Element.GetParameterValueByName(element=all_elements_of_category_2, parameterName=code_block_7.out1)
eq = getParameterValueByName_5 == code_block_7.out4
filterByBoolMask = List.FilterByBoolMask(list=all_elements_of_category_2, mask=eq)
watch_7 = Watch(filterByBoolMask.in)

# group: Have parameter "Supply air"
parameterExists = Custom[Element.ParameterExists](param=code_block_7.out2, element=watch_7)  # package Clockwork for Dynamo 2.x; Checks if an element contains a parameter of a given name
filterByBoolMask_2 = List.FilterByBoolMask(list=watch_7, mask=parameterExists)

# group: and Family name contains Room
type = archilab.Revit.Elements.Elements.Type(element=filterByBoolMask_2.in)
string_from_object_2 = FromObject(obj=type)
contains = String.Contains(str=string_from_object_2, searchFor=code_block_7.out5)

# group: Room name ==> @ Unit ref instance
filterByBoolMask_3 = List.FilterByBoolMask(list=filterByBoolMask_2.in, mask=contains)
watch_8 = Watch(filterByBoolMask_3.in)
code_block_8 = CodeBlock { "@Unit Reference Instance"; "MECH"; "ADMIN"; "Room Name"; }
getParameterValueByName_6 = Element.GetParameterValueByName(element=watch_8, parameterName=code_block_8.out3)
watch_9 = Watch(getParameterValueByName_6)
toUpper_3 = String.ToUpper(str=watch_9)
setParameterByName_7 = Element.SetParameterByName(element=watch_8, parameterName=code_block_8.out0, value=toUpper_3)
