# Dynamo graph 210514 - Set cad link view to plan view.dyn (Dynamo 2.12.1.8246)
# packages: archi-lab.net 2021.25.2621

# group: Plan Vew collector
element_types = ElementTypes("ViewPlan")
all_elements_of_type = ElementsOfType(element_type=element_types)
string_from_object = FromObject(obj=all_elements_of_type)

# group: Views to modify
view_name = CodeBlock()
# ---------- view_name.designscript (36 lines) ----------
"Not Used - 01 - NzA - 70-ME-Existing";
"Not Used - 01 - NzB - 70-ME-Existing";
"Not Used - 02 - NzA - 70-ME-Existing";
"Not Used - 02 - NzB - 70-ME-Existing";
"Not Used - 03 - NzA - 70-ME-Existing";
"Not Used - 03 - NzB - 70-ME-Existing";
"Not Used - 04 - NzA - 70-ME-Existing";
"Not Used - 04 - NzB - 70-ME-Existing";
"Not Used - 05 - NzA - 70-ME-Existing";
"Not Used - 05 - NzB - 70-ME-Existing";
"Not Used - 06 - NzA - 70-ME-Existing";
"Not Used - 06 - NzB - 70-ME-Existing";
"Not Used - 07 - NzA - 70-ME-Existing";
"Not Used - 07 - NzB - 70-ME-Existing";
"Not Used - 08 - NzA - 70-ME-Existing";
"Not Used - 08 - NzB - 70-ME-Existing";
"Not Used - 09 - NzA - 70-ME-Existing";
"Not Used - 09 - NzB - 70-ME-Existing";
"Not Used - 01 - NzA - 70-ME-New";
"Not Used - 01 - NzB - 70-ME-New";
"Not Used - 02 - NzA - 70-ME-New";
"Not Used - 02 - NzB - 70-ME-New";
"Not Used - 03 - NzA - 70-ME-New";
"Not Used - 03 - NzB - 70-ME-New";
"Not Used - 04 - NzA - 70-ME-New";
"Not Used - 04 - NzB - 70-ME-New";
"Not Used - 05 - NzA - 70-ME-New";
"Not Used - 05 - NzB - 70-ME-New";
"Not Used - 06 - NzA - 70-ME-New";
"Not Used - 06 - NzB - 70-ME-New";
"Not Used - 07 - NzA - 70-ME-New";
"Not Used - 07 - NzB - 70-ME-New";
"Not Used - 08 - NzA - 70-ME-New";
"Not Used - 08 - NzB - 70-ME-New";
"Not Used - 09 - NzA - 70-ME-New";
"Not Used - 09 - NzB - 70-ME-New";
# ----------------------------------------
list_create = List.Create(item0=view_name.out0, item1=view_name.out1, item2=view_name.out2, item3=view_name.out3, item4=view_name.out4, item5=view_name.out5, item6=view_name.out6, item7=view_name.out7, item8=view_name.out8, item9=view_name.out9, item10=view_name.out10, item11=view_name.out11, item12=view_name.out12, item13=view_name.out13, item14=view_name.out14, item15=view_name.out15, item16=view_name.out16, item17=view_name.out17)
code_block = CodeBlock(view=list_create)
# ---------- code_block.designscript (18 lines) ----------
view[0];
view[1];
view[2];
view[3];
view[4];
view[5];
view[6];
view[7];
view[8];
view[9];
view[10];
view[11];
view[12];
view[13];
view[14];
view[15];
view[16];
view[17];
# ----------------------------------------
list_create_2 = List.Create(item0=view_name.out18, item1=view_name.out19, item2=view_name.out20, item3=view_name.out21, item4=view_name.out22, item5=view_name.out23, item6=view_name.out24, item7=view_name.out25, item8=view_name.out26, item9=view_name.out27, item10=view_name.out28, item11=view_name.out29, item12=view_name.out30, item13=view_name.out31, item14=view_name.out32, item15=view_name.out33, item16=view_name.out34, item17=view_name.out35)

# group: View selection
contains = String.Contains(string=string_from_object, searchFor=code_block.out0)
filterByBoolMask = List.FilterByBoolMask(list=all_elements_of_type, mask=contains)

# group: Turn all dwg links off
getImportedCategories = archilab.Revit.Views.Views.GetImportedCategories(view=filterByBoolMask.in)
boolean = BoolSelector(false)
setImportedCategoriesVisibility = archilab.Revit.Views.Views.SetImportedCategoriesVisibility(view=filterByBoolMask.in, category=getImportedCategories.DWG, visible=boolean)

# group: partial match for imported category .dwg name
latest_imports = CodeBlock()
# ---------- latest_imports.designscript (18 lines) ----------
"MZ201100";
"MZ201200";
"MZ202100";
"MZ202200";
"MZ203100";
"MZ203200";
"MZ204100";
"MZ204200";
"MZ205100";
"MZ205200";
"MZ206100";
"MZ206200";
"MZ207100";
"MZ207200";
"MZ208100";
"MZ208200";
"MZ209100";
"MZ209200";
# ----------------------------------------
list_create_3 = List.Create(item0=latest_imports.out0, item1=latest_imports.out1, item2=latest_imports.out2, item3=latest_imports.out3, item4=latest_imports.out4, item5=latest_imports.out5, item6=latest_imports.out6, item7=latest_imports.out7, item8=latest_imports.out8, item9=latest_imports.out9, item10=latest_imports.out10, item11=latest_imports.out11, item12=latest_imports.out12, item13=latest_imports.out13, item14=latest_imports.out14, item15=latest_imports.out15, item16=latest_imports.out16, item17=latest_imports.out17)
code_block_2 = CodeBlock(dwgLink=list_create_3)
# ---------- code_block_2.designscript (18 lines) ----------
dwgLink[0];
dwgLink[1];
dwgLink[2];
dwgLink[3];
dwgLink[4];
dwgLink[5];
dwgLink[6];
dwgLink[7];
dwgLink[8];
dwgLink[9];
dwgLink[10];
dwgLink[11];
dwgLink[12];
dwgLink[13];
dwgLink[14];
dwgLink[15];
dwgLink[16];
dwgLink[17];
# ----------------------------------------
latest_imports_2 = CodeBlock { "Lv01"; "Lv02"; "Lv03"; "Lv04"; "Lv05"; "Lv06"; "Lv07"; "Lv08"; "Lv09"; }
list_create_4 = List.Create(item0=latest_imports_2.out0, item1=latest_imports_2.out0, item2=latest_imports_2.out1, item3=latest_imports_2.out1, item4=latest_imports_2.out2, item5=latest_imports_2.out2, item6=latest_imports_2.out3, item7=latest_imports_2.out3, item8=latest_imports_2.out4, item9=latest_imports_2.out4, item10=latest_imports_2.out5, item11=latest_imports_2.out5, item12=latest_imports_2.out6, item13=latest_imports_2.out6, item14=latest_imports_2.out7, item15=latest_imports_2.out7, item16=latest_imports_2.out8, item17=latest_imports_2.out8)

# group: Turn On Selected only
code_block_3 = CodeBlock(x=getImportedCategories.DWG) { x[0]; }
string_from_object_2 = FromObject(obj=code_block_3)
contains_2 = String.Contains(string=string_from_object_2, searchFor=code_block_2.out0)
filterByBoolMask_2 = List.FilterByBoolMask(list=code_block_3, mask=contains_2)
boolean_2 = BoolSelector(true)
setImportedCategoriesVisibility_2 = archilab.Revit.Views.Views.SetImportedCategoriesVisibility(view=setImportedCategoriesVisibility, category=filterByBoolMask_2.in, visible=boolean_2)

# group: Set halftone
boolean_3 = BoolSelector(true)
byProperties = Revit.Filter.OverrideGraphicSettings.ByProperties(halftone=boolean_3)
boolean_4 = BoolSelector(false)
setCategoryOverrides = View.SetCategoryOverrides(view=setImportedCategoriesVisibility_2, category=filterByBoolMask_2.in, overrides=byProperties, hide=boolean_4)

# group: View selection
contains_3 = String.Contains(string=string_from_object, searchFor=code_block.out1)
filterByBoolMask_3 = List.FilterByBoolMask(list=all_elements_of_type, mask=contains_3)

# group: Turn all dwg links off
getImportedCategories_2 = archilab.Revit.Views.Views.GetImportedCategories(view=filterByBoolMask_3.in)
boolean_5 = BoolSelector(false)
setImportedCategoriesVisibility_3 = archilab.Revit.Views.Views.SetImportedCategoriesVisibility(view=filterByBoolMask_3.in, category=getImportedCategories_2.DWG, visible=boolean_5)

# group: Turn On Selected only
code_block_4 = CodeBlock(x=getImportedCategories_2.DWG) { x[0]; }
string_from_object_3 = FromObject(obj=code_block_4)
contains_4 = String.Contains(string=string_from_object_3, searchFor=code_block_2.out1)
filterByBoolMask_4 = List.FilterByBoolMask(list=code_block_4, mask=contains_4)
boolean_6 = BoolSelector(true)
setImportedCategoriesVisibility_4 = archilab.Revit.Views.Views.SetImportedCategoriesVisibility(view=setImportedCategoriesVisibility_3, category=filterByBoolMask_4.in, visible=boolean_6)

# group: Set halftone
boolean_7 = BoolSelector(true)
byProperties_2 = Revit.Filter.OverrideGraphicSettings.ByProperties(halftone=boolean_7)
boolean_8 = BoolSelector(false)
setCategoryOverrides_2 = View.SetCategoryOverrides(view=setImportedCategoriesVisibility_4, category=filterByBoolMask_4.in, overrides=byProperties_2, hide=boolean_8)

# group: View selection
contains_5 = String.Contains(string=string_from_object, searchFor=code_block.out2)
filterByBoolMask_5 = List.FilterByBoolMask(list=all_elements_of_type, mask=contains_5)

# group: Turn all dwg links off
getImportedCategories_3 = archilab.Revit.Views.Views.GetImportedCategories(view=filterByBoolMask_5.in)
boolean_9 = BoolSelector(false)
setImportedCategoriesVisibility_5 = archilab.Revit.Views.Views.SetImportedCategoriesVisibility(view=filterByBoolMask_5.in, category=getImportedCategories_3.DWG, visible=boolean_9)

# group: Turn On Selected only
code_block_5 = CodeBlock(x=getImportedCategories_3.DWG) { x[0]; }
string_from_object_4 = FromObject(obj=code_block_5)
contains_6 = String.Contains(string=string_from_object_4, searchFor=code_block_2.out2)
filterByBoolMask_6 = List.FilterByBoolMask(list=code_block_5, mask=contains_6)
boolean_10 = BoolSelector(true)
setImportedCategoriesVisibility_6 = archilab.Revit.Views.Views.SetImportedCategoriesVisibility(view=setImportedCategoriesVisibility_5, category=filterByBoolMask_6.in, visible=boolean_10)

# group: Set halftone
boolean_11 = BoolSelector(true)
byProperties_3 = Revit.Filter.OverrideGraphicSettings.ByProperties(halftone=boolean_11)
boolean_12 = BoolSelector(false)
setCategoryOverrides_3 = View.SetCategoryOverrides(view=setImportedCategoriesVisibility_6, category=filterByBoolMask_6.in, overrides=byProperties_3, hide=boolean_12)

# group: View selection
contains_7 = String.Contains(string=string_from_object, searchFor=code_block.out3)
filterByBoolMask_7 = List.FilterByBoolMask(list=all_elements_of_type, mask=contains_7)

# group: Turn all dwg links off
getImportedCategories_4 = archilab.Revit.Views.Views.GetImportedCategories(view=filterByBoolMask_7.in)
boolean_13 = BoolSelector(false)
setImportedCategoriesVisibility_7 = archilab.Revit.Views.Views.SetImportedCategoriesVisibility(view=filterByBoolMask_7.in, category=getImportedCategories_4.DWG, visible=boolean_13)

# group: Turn On Selected only
code_block_6 = CodeBlock(x=getImportedCategories_4.DWG) { x[0]; }
string_from_object_5 = FromObject(obj=code_block_6)
contains_8 = String.Contains(string=string_from_object_5, searchFor=code_block_2.out3)
filterByBoolMask_8 = List.FilterByBoolMask(list=code_block_6, mask=contains_8)
boolean_14 = BoolSelector(true)
setImportedCategoriesVisibility_8 = archilab.Revit.Views.Views.SetImportedCategoriesVisibility(view=setImportedCategoriesVisibility_7, category=filterByBoolMask_8.in, visible=boolean_14)

# group: Set halftone
boolean_15 = BoolSelector(true)
byProperties_4 = Revit.Filter.OverrideGraphicSettings.ByProperties(halftone=boolean_15)
boolean_16 = BoolSelector(false)
setCategoryOverrides_4 = View.SetCategoryOverrides(view=setImportedCategoriesVisibility_8, category=filterByBoolMask_8.in, overrides=byProperties_4, hide=boolean_16)

# group: View selection
contains_9 = String.Contains(string=string_from_object, searchFor=code_block.out4)
filterByBoolMask_9 = List.FilterByBoolMask(list=all_elements_of_type, mask=contains_9)

# group: Turn all dwg links off
getImportedCategories_5 = archilab.Revit.Views.Views.GetImportedCategories(view=filterByBoolMask_9.in)
boolean_17 = BoolSelector(false)
setImportedCategoriesVisibility_9 = archilab.Revit.Views.Views.SetImportedCategoriesVisibility(view=filterByBoolMask_9.in, category=getImportedCategories_5.DWG, visible=boolean_17)

# group: Turn On Selected only
code_block_7 = CodeBlock(x=getImportedCategories_5.DWG) { x[0]; }
string_from_object_6 = FromObject(obj=code_block_7)
contains_10 = String.Contains(string=string_from_object_6, searchFor=code_block_2.out4)
filterByBoolMask_10 = List.FilterByBoolMask(list=code_block_7, mask=contains_10)
boolean_18 = BoolSelector(true)
setImportedCategoriesVisibility_10 = archilab.Revit.Views.Views.SetImportedCategoriesVisibility(view=setImportedCategoriesVisibility_9, category=filterByBoolMask_10.in, visible=boolean_18)

# group: Set halftone
boolean_19 = BoolSelector(true)
byProperties_5 = Revit.Filter.OverrideGraphicSettings.ByProperties(halftone=boolean_19)
boolean_20 = BoolSelector(false)
setCategoryOverrides_5 = View.SetCategoryOverrides(view=setImportedCategoriesVisibility_10, category=filterByBoolMask_10.in, overrides=byProperties_5, hide=boolean_20)

# group: View selection
contains_11 = String.Contains(string=string_from_object, searchFor=code_block.out8)
filterByBoolMask_11 = List.FilterByBoolMask(list=all_elements_of_type, mask=contains_11)

# group: Turn all dwg links off
getImportedCategories_6 = archilab.Revit.Views.Views.GetImportedCategories(view=filterByBoolMask_11.in)
boolean_21 = BoolSelector(false)
setImportedCategoriesVisibility_11 = archilab.Revit.Views.Views.SetImportedCategoriesVisibility(view=filterByBoolMask_11.in, category=getImportedCategories_6.DWG, visible=boolean_21)

# group: Turn On Selected only
code_block_8 = CodeBlock(x=getImportedCategories_6.DWG) { x[0]; }
string_from_object_7 = FromObject(obj=code_block_8)
contains_12 = String.Contains(string=string_from_object_7, searchFor=code_block_2.out8)
filterByBoolMask_12 = List.FilterByBoolMask(list=code_block_8, mask=contains_12)
boolean_22 = BoolSelector(true)
setImportedCategoriesVisibility_12 = archilab.Revit.Views.Views.SetImportedCategoriesVisibility(view=setImportedCategoriesVisibility_11, category=filterByBoolMask_12.in, visible=boolean_22)

# group: Set halftone
boolean_23 = BoolSelector(true)
byProperties_6 = Revit.Filter.OverrideGraphicSettings.ByProperties(halftone=boolean_23)
boolean_24 = BoolSelector(false)
setCategoryOverrides_6 = View.SetCategoryOverrides(view=setImportedCategoriesVisibility_12, category=filterByBoolMask_12.in, overrides=byProperties_6, hide=boolean_24)

# group: View selection
contains_13 = String.Contains(string=string_from_object, searchFor=code_block.out7)
filterByBoolMask_13 = List.FilterByBoolMask(list=all_elements_of_type, mask=contains_13)

# group: Turn all dwg links off
getImportedCategories_7 = archilab.Revit.Views.Views.GetImportedCategories(view=filterByBoolMask_13.in)
boolean_25 = BoolSelector(false)
setImportedCategoriesVisibility_13 = archilab.Revit.Views.Views.SetImportedCategoriesVisibility(view=filterByBoolMask_13.in, category=getImportedCategories_7.DWG, visible=boolean_25)

# group: Turn On Selected only
code_block_9 = CodeBlock(x=getImportedCategories_7.DWG) { x[0]; }
string_from_object_8 = FromObject(obj=code_block_9)
contains_14 = String.Contains(string=string_from_object_8, searchFor=code_block_2.out7)
filterByBoolMask_14 = List.FilterByBoolMask(list=code_block_9, mask=contains_14)
boolean_26 = BoolSelector(true)
setImportedCategoriesVisibility_14 = archilab.Revit.Views.Views.SetImportedCategoriesVisibility(view=setImportedCategoriesVisibility_13, category=filterByBoolMask_14.in, visible=boolean_26)

# group: Set halftone
boolean_27 = BoolSelector(true)
byProperties_7 = Revit.Filter.OverrideGraphicSettings.ByProperties(halftone=boolean_27)
boolean_28 = BoolSelector(false)
setCategoryOverrides_7 = View.SetCategoryOverrides(view=setImportedCategoriesVisibility_14, category=filterByBoolMask_14.in, overrides=byProperties_7, hide=boolean_28)

# group: View selection
contains_15 = String.Contains(string=string_from_object, searchFor=code_block.out6)
filterByBoolMask_15 = List.FilterByBoolMask(list=all_elements_of_type, mask=contains_15)

# group: Turn all dwg links off
getImportedCategories_8 = archilab.Revit.Views.Views.GetImportedCategories(view=filterByBoolMask_15.in)
boolean_29 = BoolSelector(false)
setImportedCategoriesVisibility_15 = archilab.Revit.Views.Views.SetImportedCategoriesVisibility(view=filterByBoolMask_15.in, category=getImportedCategories_8.DWG, visible=boolean_29)

# group: Turn On Selected only
code_block_10 = CodeBlock(x=getImportedCategories_8.DWG) { x[0]; }
string_from_object_9 = FromObject(obj=code_block_10)
contains_16 = String.Contains(string=string_from_object_9, searchFor=code_block_2.out6)
filterByBoolMask_16 = List.FilterByBoolMask(list=code_block_10, mask=contains_16)
boolean_30 = BoolSelector(true)
setImportedCategoriesVisibility_16 = archilab.Revit.Views.Views.SetImportedCategoriesVisibility(view=setImportedCategoriesVisibility_15, category=filterByBoolMask_16.in, visible=boolean_30)

# group: Set halftone
boolean_31 = BoolSelector(true)
byProperties_8 = Revit.Filter.OverrideGraphicSettings.ByProperties(halftone=boolean_31)
boolean_32 = BoolSelector(false)
setCategoryOverrides_8 = View.SetCategoryOverrides(view=setImportedCategoriesVisibility_16, category=filterByBoolMask_16.in, overrides=byProperties_8, hide=boolean_32)

# group: View selection
contains_17 = String.Contains(string=string_from_object, searchFor=code_block.out5)
filterByBoolMask_17 = List.FilterByBoolMask(list=all_elements_of_type, mask=contains_17)

# group: Turn all dwg links off
getImportedCategories_9 = archilab.Revit.Views.Views.GetImportedCategories(view=filterByBoolMask_17.in)
boolean_33 = BoolSelector(false)
setImportedCategoriesVisibility_17 = archilab.Revit.Views.Views.SetImportedCategoriesVisibility(view=filterByBoolMask_17.in, category=getImportedCategories_9.DWG, visible=boolean_33)

# group: Turn On Selected only
code_block_11 = CodeBlock(x=getImportedCategories_9.DWG) { x[0]; }
string_from_object_10 = FromObject(obj=code_block_11)
contains_18 = String.Contains(string=string_from_object_10, searchFor=code_block_2.out5)
filterByBoolMask_18 = List.FilterByBoolMask(list=code_block_11, mask=contains_18)
boolean_34 = BoolSelector(true)
setImportedCategoriesVisibility_18 = archilab.Revit.Views.Views.SetImportedCategoriesVisibility(view=setImportedCategoriesVisibility_17, category=filterByBoolMask_18.in, visible=boolean_34)

# group: Set halftone
boolean_35 = BoolSelector(true)
byProperties_9 = Revit.Filter.OverrideGraphicSettings.ByProperties(halftone=boolean_35)
boolean_36 = BoolSelector(false)
setCategoryOverrides_9 = View.SetCategoryOverrides(view=setImportedCategoriesVisibility_18, category=filterByBoolMask_18.in, overrides=byProperties_9, hide=boolean_36)

# group: View selection
contains_19 = String.Contains(string=string_from_object, searchFor=code_block.out9)
filterByBoolMask_19 = List.FilterByBoolMask(list=all_elements_of_type, mask=contains_19)

# group: Turn all dwg links off
getImportedCategories_10 = archilab.Revit.Views.Views.GetImportedCategories(view=filterByBoolMask_19.in)
boolean_37 = BoolSelector(false)
setImportedCategoriesVisibility_19 = archilab.Revit.Views.Views.SetImportedCategoriesVisibility(view=filterByBoolMask_19.in, category=getImportedCategories_10.DWG, visible=boolean_37)

# group: Turn On Selected only
code_block_12 = CodeBlock(x=getImportedCategories_10.DWG) { x[0]; }
string_from_object_11 = FromObject(obj=code_block_12)
contains_20 = String.Contains(string=string_from_object_11, searchFor=code_block_2.out9)
filterByBoolMask_20 = List.FilterByBoolMask(list=code_block_12, mask=contains_20)
boolean_38 = BoolSelector(true)
setImportedCategoriesVisibility_20 = archilab.Revit.Views.Views.SetImportedCategoriesVisibility(view=setImportedCategoriesVisibility_19, category=filterByBoolMask_20.in, visible=boolean_38)

# group: Set halftone
boolean_39 = BoolSelector(true)
byProperties_10 = Revit.Filter.OverrideGraphicSettings.ByProperties(halftone=boolean_39)
boolean_40 = BoolSelector(false)
setCategoryOverrides_10 = View.SetCategoryOverrides(view=setImportedCategoriesVisibility_20, category=filterByBoolMask_20.in, overrides=byProperties_10, hide=boolean_40)

# group: View selection
contains_21 = String.Contains(string=string_from_object, searchFor=code_block.out10)
filterByBoolMask_21 = List.FilterByBoolMask(list=all_elements_of_type, mask=contains_21)

# group: Turn all dwg links off
getImportedCategories_11 = archilab.Revit.Views.Views.GetImportedCategories(view=filterByBoolMask_21.in)
boolean_41 = BoolSelector(false)
setImportedCategoriesVisibility_21 = archilab.Revit.Views.Views.SetImportedCategoriesVisibility(view=filterByBoolMask_21.in, category=getImportedCategories_11.DWG, visible=boolean_41)

# group: Turn On Selected only
code_block_13 = CodeBlock(x=getImportedCategories_11.DWG) { x[0]; }
string_from_object_12 = FromObject(obj=code_block_13)
contains_22 = String.Contains(string=string_from_object_12, searchFor=code_block_2.out10)
filterByBoolMask_22 = List.FilterByBoolMask(list=code_block_13, mask=contains_22)
boolean_42 = BoolSelector(true)
setImportedCategoriesVisibility_22 = archilab.Revit.Views.Views.SetImportedCategoriesVisibility(view=setImportedCategoriesVisibility_21, category=filterByBoolMask_22.in, visible=boolean_42)

# group: Set halftone
boolean_43 = BoolSelector(true)
byProperties_11 = Revit.Filter.OverrideGraphicSettings.ByProperties(halftone=boolean_43)
boolean_44 = BoolSelector(false)
setCategoryOverrides_11 = View.SetCategoryOverrides(view=setImportedCategoriesVisibility_22, category=filterByBoolMask_22.in, overrides=byProperties_11, hide=boolean_44)

# group: View selection
contains_23 = String.Contains(string=string_from_object, searchFor=code_block.out11)
filterByBoolMask_23 = List.FilterByBoolMask(list=all_elements_of_type, mask=contains_23)

# group: Turn all dwg links off
getImportedCategories_12 = archilab.Revit.Views.Views.GetImportedCategories(view=filterByBoolMask_23.in)
boolean_45 = BoolSelector(false)
setImportedCategoriesVisibility_23 = archilab.Revit.Views.Views.SetImportedCategoriesVisibility(view=filterByBoolMask_23.in, category=getImportedCategories_12.DWG, visible=boolean_45)

# group: Turn On Selected only
code_block_14 = CodeBlock(x=getImportedCategories_12.DWG) { x[0]; }
string_from_object_13 = FromObject(obj=code_block_14)
contains_24 = String.Contains(string=string_from_object_13, searchFor=code_block_2.out11)
filterByBoolMask_24 = List.FilterByBoolMask(list=code_block_14, mask=contains_24)
boolean_46 = BoolSelector(true)
setImportedCategoriesVisibility_24 = archilab.Revit.Views.Views.SetImportedCategoriesVisibility(view=setImportedCategoriesVisibility_23, category=filterByBoolMask_24.in, visible=boolean_46)

# group: Set halftone
boolean_47 = BoolSelector(true)
byProperties_12 = Revit.Filter.OverrideGraphicSettings.ByProperties(halftone=boolean_47)
boolean_48 = BoolSelector(false)
setCategoryOverrides_12 = View.SetCategoryOverrides(view=setImportedCategoriesVisibility_24, category=filterByBoolMask_24.in, overrides=byProperties_12, hide=boolean_48)

# group: View selection
contains_25 = String.Contains(string=string_from_object, searchFor=code_block.out12)
filterByBoolMask_25 = List.FilterByBoolMask(list=all_elements_of_type, mask=contains_25)

# group: Turn all dwg links off
getImportedCategories_13 = archilab.Revit.Views.Views.GetImportedCategories(view=filterByBoolMask_25.in)
boolean_49 = BoolSelector(false)
setImportedCategoriesVisibility_25 = archilab.Revit.Views.Views.SetImportedCategoriesVisibility(view=filterByBoolMask_25.in, category=getImportedCategories_13.DWG, visible=boolean_49)

# group: Turn On Selected only
code_block_15 = CodeBlock(x=getImportedCategories_13.DWG) { x[0]; }
string_from_object_14 = FromObject(obj=code_block_15)
contains_26 = String.Contains(string=string_from_object_14, searchFor=code_block_2.out12)
filterByBoolMask_26 = List.FilterByBoolMask(list=code_block_15, mask=contains_26)
boolean_50 = BoolSelector(true)
setImportedCategoriesVisibility_26 = archilab.Revit.Views.Views.SetImportedCategoriesVisibility(view=setImportedCategoriesVisibility_25, category=filterByBoolMask_26.in, visible=boolean_50)
code_block_16 = CodeBlock { "Lv04"; }

# group: Set halftone
boolean_51 = BoolSelector(true)
byProperties_13 = Revit.Filter.OverrideGraphicSettings.ByProperties(halftone=boolean_51)
boolean_52 = BoolSelector(false)
setCategoryOverrides_13 = View.SetCategoryOverrides(view=setImportedCategoriesVisibility_26, category=filterByBoolMask_26.in, overrides=byProperties_13, hide=boolean_52)

# group: View selection
contains_27 = String.Contains(string=string_from_object, searchFor=code_block.out13)
filterByBoolMask_27 = List.FilterByBoolMask(list=all_elements_of_type, mask=contains_27)

# group: Turn all dwg links off
getImportedCategories_14 = archilab.Revit.Views.Views.GetImportedCategories(view=filterByBoolMask_27.in)
boolean_53 = BoolSelector(false)
setImportedCategoriesVisibility_27 = archilab.Revit.Views.Views.SetImportedCategoriesVisibility(view=filterByBoolMask_27.in, category=getImportedCategories_14.DWG, visible=boolean_53)

# group: Turn On Selected only
code_block_17 = CodeBlock(x=getImportedCategories_14.DWG) { x[0]; }
string_from_object_15 = FromObject(obj=code_block_17)
contains_28 = String.Contains(string=string_from_object_15, searchFor=code_block_2.out13)
filterByBoolMask_28 = List.FilterByBoolMask(list=code_block_17, mask=contains_28)
boolean_54 = BoolSelector(true)
setImportedCategoriesVisibility_28 = archilab.Revit.Views.Views.SetImportedCategoriesVisibility(view=setImportedCategoriesVisibility_27, category=filterByBoolMask_28.in, visible=boolean_54)

# group: Set halftone
boolean_55 = BoolSelector(true)
byProperties_14 = Revit.Filter.OverrideGraphicSettings.ByProperties(halftone=boolean_55)
boolean_56 = BoolSelector(false)
setCategoryOverrides_14 = View.SetCategoryOverrides(view=setImportedCategoriesVisibility_28, category=filterByBoolMask_28.in, overrides=byProperties_14, hide=boolean_56)

# group: View selection
contains_29 = String.Contains(string=string_from_object, searchFor=code_block.out15)
filterByBoolMask_29 = List.FilterByBoolMask(list=all_elements_of_type, mask=contains_29)

# group: Turn all dwg links off
getImportedCategories_15 = archilab.Revit.Views.Views.GetImportedCategories(view=filterByBoolMask_29.in)
boolean_57 = BoolSelector(false)
setImportedCategoriesVisibility_29 = archilab.Revit.Views.Views.SetImportedCategoriesVisibility(view=filterByBoolMask_29.in, category=getImportedCategories_15.DWG, visible=boolean_57)

# group: Turn On Selected only
code_block_18 = CodeBlock(x=getImportedCategories_15.DWG) { x[0]; }
string_from_object_16 = FromObject(obj=code_block_18)
contains_30 = String.Contains(string=string_from_object_16, searchFor=code_block_2.out15)
filterByBoolMask_30 = List.FilterByBoolMask(list=code_block_18, mask=contains_30)
boolean_58 = BoolSelector(true)
setImportedCategoriesVisibility_30 = archilab.Revit.Views.Views.SetImportedCategoriesVisibility(view=setImportedCategoriesVisibility_29, category=filterByBoolMask_30.in, visible=boolean_58)

# group: Set halftone
boolean_59 = BoolSelector(true)
byProperties_15 = Revit.Filter.OverrideGraphicSettings.ByProperties(halftone=boolean_59)
boolean_60 = BoolSelector(false)
setCategoryOverrides_15 = View.SetCategoryOverrides(view=setImportedCategoriesVisibility_30, category=filterByBoolMask_30.in, overrides=byProperties_15, hide=boolean_60)

# group: View selection
contains_31 = String.Contains(string=string_from_object, searchFor=code_block.out14)
filterByBoolMask_31 = List.FilterByBoolMask(list=all_elements_of_type, mask=contains_31)

# group: Turn all dwg links off
getImportedCategories_16 = archilab.Revit.Views.Views.GetImportedCategories(view=filterByBoolMask_31.in)
boolean_61 = BoolSelector(false)
setImportedCategoriesVisibility_31 = archilab.Revit.Views.Views.SetImportedCategoriesVisibility(view=filterByBoolMask_31.in, category=getImportedCategories_16.DWG, visible=boolean_61)

# group: Turn On Selected only
code_block_19 = CodeBlock(x=getImportedCategories_16.DWG) { x[0]; }
string_from_object_17 = FromObject(obj=code_block_19)
contains_32 = String.Contains(string=string_from_object_17, searchFor=code_block_2.out14)
filterByBoolMask_32 = List.FilterByBoolMask(list=code_block_19, mask=contains_32)
boolean_62 = BoolSelector(true)
setImportedCategoriesVisibility_32 = archilab.Revit.Views.Views.SetImportedCategoriesVisibility(view=setImportedCategoriesVisibility_31, category=filterByBoolMask_32.in, visible=boolean_62)

# group: Set halftone
boolean_63 = BoolSelector(true)
byProperties_16 = Revit.Filter.OverrideGraphicSettings.ByProperties(halftone=boolean_63)
boolean_64 = BoolSelector(false)
setCategoryOverrides_16 = View.SetCategoryOverrides(view=setImportedCategoriesVisibility_32, category=filterByBoolMask_32.in, overrides=byProperties_16, hide=boolean_64)

# group: View selection
contains_33 = String.Contains(string=string_from_object, searchFor=code_block.out16)
filterByBoolMask_33 = List.FilterByBoolMask(list=all_elements_of_type, mask=contains_33)

# group: Turn all dwg links off
getImportedCategories_17 = archilab.Revit.Views.Views.GetImportedCategories(view=filterByBoolMask_33.in)
boolean_65 = BoolSelector(false)
setImportedCategoriesVisibility_33 = archilab.Revit.Views.Views.SetImportedCategoriesVisibility(view=filterByBoolMask_33.in, category=getImportedCategories_17.DWG, visible=boolean_65)

# group: Turn On Selected only
code_block_20 = CodeBlock(x=getImportedCategories_17.DWG) { x[0]; }
string_from_object_18 = FromObject(obj=code_block_20)
contains_34 = String.Contains(string=string_from_object_18, searchFor=code_block_2.out16)
filterByBoolMask_34 = List.FilterByBoolMask(list=code_block_20, mask=contains_34)
boolean_66 = BoolSelector(true)
setImportedCategoriesVisibility_34 = archilab.Revit.Views.Views.SetImportedCategoriesVisibility(view=setImportedCategoriesVisibility_33, category=filterByBoolMask_34.in, visible=boolean_66)

# group: Set halftone
boolean_67 = BoolSelector(true)
byProperties_17 = Revit.Filter.OverrideGraphicSettings.ByProperties(halftone=boolean_67)
boolean_68 = BoolSelector(false)
setCategoryOverrides_17 = View.SetCategoryOverrides(view=setImportedCategoriesVisibility_34, category=filterByBoolMask_34.in, overrides=byProperties_17, hide=boolean_68)

# group: View selection
contains_35 = String.Contains(string=string_from_object, searchFor=code_block.out17)
filterByBoolMask_35 = List.FilterByBoolMask(list=all_elements_of_type, mask=contains_35)

# group: Turn all dwg links off
getImportedCategories_18 = archilab.Revit.Views.Views.GetImportedCategories(view=filterByBoolMask_35.in)
boolean_69 = BoolSelector(false)
setImportedCategoriesVisibility_35 = archilab.Revit.Views.Views.SetImportedCategoriesVisibility(view=filterByBoolMask_35.in, category=getImportedCategories_18.DWG, visible=boolean_69)

# group: Turn On Selected only
code_block_21 = CodeBlock(x=getImportedCategories_18.DWG) { x[0]; }
string_from_object_19 = FromObject(obj=code_block_21)
contains_36 = String.Contains(string=string_from_object_19, searchFor=code_block_2.out17)
filterByBoolMask_36 = List.FilterByBoolMask(list=code_block_21, mask=contains_36)
boolean_70 = BoolSelector(true)
setImportedCategoriesVisibility_36 = archilab.Revit.Views.Views.SetImportedCategoriesVisibility(view=setImportedCategoriesVisibility_35, category=filterByBoolMask_36.in, visible=boolean_70)

# group: Set halftone
boolean_71 = BoolSelector(true)
byProperties_18 = Revit.Filter.OverrideGraphicSettings.ByProperties(halftone=boolean_71)
boolean_72 = BoolSelector(false)
setCategoryOverrides_18 = View.SetCategoryOverrides(view=setImportedCategoriesVisibility_36, category=filterByBoolMask_36.in, overrides=byProperties_18, hide=boolean_72)
