# Dynamo graph 211018 - CHW Volume.dyn (Dynamo 2.3.1.11775)
# packages: archi-lab.net 2020.23.13

categories = Categories("OST_PipeCurves")  # graph input
all_elements_of_category = ElementsOfCategory(Category=categories)
code_block = CodeBlock { "System Abbreviation"; }
getParameterValueByName = Element.GetParameterValueByName(element=all_elements_of_category, parameterName=code_block, lacing=Longest)
code_block_2 = CodeBlock { "CHWF"; }
contains = List.Contains(list=getParameterValueByName, item=code_block_2, lacing=Longest)
filterByBoolMask = List.FilterByBoolMask(list=all_elements_of_category, mask=contains)

# group: Length - m
code_block_3 = CodeBlock { "Length"; }
getParameterValueByName_2 = Element.GetParameterValueByName(element=filterByBoolMask.in, parameterName=code_block_3)
number = DoubleInput(0.001)  # graph input
mul = getParameterValueByName_2 * number  # lacing=Longest
sum = Math.Sum(values=mul)
code_block_4 = CodeBlock { 4; 2; }
round = Math.Round(number=mul, digits=code_block_4.out1)

# group: Pipe - NB check
relay = Relay(filterByBoolMask.in)
code_block_5 = CodeBlock { "Diameter"; }
getParameterValueByName_3 = Element.GetParameterValueByName(element=relay, parameterName=code_block_5)

code_block_6 = CodeBlock { "Inside Diameter"; }
getParameterValueByName_4 = Element.GetParameterValueByName(element=filterByBoolMask.in, parameterName=code_block_6)

# group: Pipe - Area - m2
code_block_7 = CodeBlock { 2; }
# note: Pipe - Radius
div = getParameterValueByName_4 / code_block_7
mul_2 = div * div  # lacing=Longest
PI = Math.PI()
# note: Pipe - Area - (Pi) x r^2
# note: mm^2
mul_3 = mul_2 * PI  # lacing=Longest
code_block_8 = CodeBlock { 1000000; }
# note: m^2
div_2 = mul_3 / code_block_8
code_block_9 = CodeBlock { 4; }
round_2 = Math.Round(number=div_2, digits=code_block_9)

# group: Volume - m3
mul_4 = div_2 * mul
code_block_10 = CodeBlock { 3; 2; }
round_3 = Math.Round(number=mul_4, digits=code_block_10.out0)
sum_2 = Math.Sum(values=mul_4)

# group: Reference Level
relay_2 = Relay(filterByBoolMask.in)
code_block_11 = CodeBlock { "Reference Level"; }
getParameterValueByName_5 = Element.GetParameterValueByName(element=relay_2, parameterName=code_block_11)

# group: Organise info to Lists for Excel
code_block_12 = CodeBlock { "Diameter - NB"; "Pipe Area - (m^2)"; "Pipe Length - (m)"; "Pipe Volume - (m^3)"; "Building Level"; }
list_create = List.Create(item0=code_block_12.out0, item1=getParameterValueByName_3)
flatten = List.Flatten(list=list_create)
list_create_2 = List.Create(item0=code_block_12.out1, item1=round_2)
flatten_2 = List.Flatten(list=list_create_2)
relay_3 = Relay(round)
list_create_3 = List.Create(item0=code_block_12.out2, item1=relay_3)
flatten_3 = List.Flatten(list=list_create_3)
relay_4 = Relay(round_3)
list_create_4 = List.Create(item0=code_block_12.out3, item1=relay_4)
flatten_4 = List.Flatten(list=list_create_4)
list_create_5 = List.Create(item0=code_block_12.out4, item1=getParameterValueByName_5)
flatten_5 = List.Flatten(list=list_create_5)
list_create_6 = List.Create(item0=flatten, item1=flatten_2, item2=flatten_3, item3=flatten_4, item4=flatten_5)

# group: Write to Excel
file_path = Filename("\\global.arup.com\australasia\SYD\Projects\283000\283890-00 AWE SY6\Work\BIM_CDE\01_WORKING\11_MEP\10_SCRIPTS\00_DYN\283890 - Equinix SY6 -Pipe vol calc.xlsx")
code_block_13 = CodeBlock { "Sheet1"; }
code_block_14 = CodeBlock { 3; 1; 0; 3; 4; 5; }
transpose = List.Transpose(lists=list_create_6)
exportExcel = Data.ExportExcel(filePath=file_path, sheetName=code_block_13, startRow=code_block_14.out0, startCol=code_block_14.out3, data=transpose, overWrite=code_block_14.out1)
