# Dynamo graph 211216 - Change_Titleblock - SY6.dyn (Dynamo 2.3.1.11775)
# packages: archi-lab.net 2021.25.2621, archi-lab.net 2020.23.13

# group: Update Revisions on sheets
select_revision = RevitRevisions()  # nothing selected; frozen
# note: [0] - Sheet
# [1] - Revision
# [2] - Runit
boolean = BoolSelector(true)
update_revisions_on_sheets = Python(IN[1]=select_revision, IN[2]=boolean)  # unwired: IN[0]
# ---------- update_revisions_on_sheets.python (75 lines) ----------
# Copyright(c) 2015, Konrad K Sobon
# @arch_laboratory, http://archi-lab.net

import clr
# Import Element wrapper extension methods
clr.AddReference("RevitNodes")
import Revit
clr.ImportExtensions(Revit.Elements)

# Import DocumentManager and TransactionManager
clr.AddReference("RevitServices")
import RevitServices
from RevitServices.Persistence import DocumentManager
from RevitServices.Transactions import TransactionManager
doc = DocumentManager.Instance.CurrentDBDocument

# Import RevitAPI
clr.AddReference("RevitAPI")
import Autodesk
from Autodesk.Revit.DB import *

import sys
pyt_path = r'C:\Program Files (x86)\IronPython 2.7\Lib'
sys.path.append(pyt_path)

import System
from System import Array
from System.Collections.Generic import *

#The inputs to this node will be stored as a list in the IN variable.
dataEnteringNode = IN

if isinstance(IN[0], list):
	sheets = []
	for i in IN[0]:
		sheets.append(UnwrapElement(i))
else:
	sheets = [UnwrapElement(IN[0])]

if isinstance(IN[1], list):
	revs = []
	for i in IN[1]:
		revs.append(UnwrapElement(i))
else:
	revs = [UnwrapElement(IN[1])]
	
RunIt = IN[2]

if RunIt:
	try:
		errorReport = None
		for i in sheets:
			revisionsOnSheet = i.GetAdditionalRevisionIds()
			for r in revs:
				if r.Id not in revisionsOnSheet:
					revisionsOnSheet.Add(r.Id)
				else:
					continue
			TransactionManager.Instance.EnsureInTransaction(doc)
			i.SetAdditionalRevisionIds(revisionsOnSheet)
			TransactionManager.Instance.TransactionTaskDone()
			
	except:
		# if error accurs anywhere in the process catch it
		import traceback
		errorReport = traceback.format_exc()
else:
	errorReport = "Set RunIt to True."


#Assign your output to the OUT variable
if errorReport == None:
	OUT = IN[0]
else:
	OUT = errorReport
# ----------------------------------------

# group: Modify selected sheets only
categories = Categories("OST_Sheets")  # graph input; frozen
all_elements_of_category = ElementsOfCategory(Category=categories)
code_block = CodeBlock { "Sheet Number"; "Sheet Name"; "Building"; }
getParameterValueByName = Element.GetParameterValueByName(element=all_elements_of_category, parameterName=code_block.out0)
code_block_2 = CodeBlock { "CBPN-MEC-1000"; "CBPN-MEC-1001"; "CBPN-MEC-1203-03"; "CBPN-MEC-1208-08"; }
list_create = List.Create(item0=code_block_2.out0, item1=code_block_2.out1, item2=code_block_2.out2, item3=code_block_2.out3)
contains = String.Contains(str=getParameterValueByName, searchFor=list_create, lacing=CrossProduct)
allFalse = List.AllFalse(list=contains@L2)
not_ = Not(x=allFalse)
filterByBoolMask = List.FilterByBoolMask(list=all_elements_of_category, mask=not_)

# group: Apply revision information
code_block_3 = CodeBlock()  # frozen
# ---------- code_block_3.designscript (14 lines) ----------
"1 - Approv.";
"KM";
"1 - Checked";
"NC-S";
"1 - Date";
"02/06/21";
"1 - Description";
"Schematic Design";
"1 - Modeled By";
"LH";
"1 - Rev.";
"A";
"ARUP_BDR_ISSUE";
"A";
# ----------------------------------------
setParameterByName = Element.SetParameterByName(element=filterByBoolMask.in, parameterName=code_block_3.out0, value=code_block_3.out1)
setParameterByName_2 = Element.SetParameterByName(element=setParameterByName, parameterName=code_block_3.out2, value=code_block_3.out3)
setParameterByName_3 = Element.SetParameterByName(element=setParameterByName_2, parameterName=code_block_3.out4, value=code_block_3.out5)
setParameterByName_4 = Element.SetParameterByName(element=setParameterByName_3, parameterName=code_block_3.out12, value=code_block_3.out13)
setParameterByName_5 = Element.SetParameterByName(element=setParameterByName_4, parameterName=code_block_3.out6, value=code_block_3.out7)
setParameterByName_6 = Element.SetParameterByName(element=setParameterByName_5, parameterName=code_block_3.out8, value=code_block_3.out9)
setParameterByName_7 = Element.SetParameterByName(element=setParameterByName_6, parameterName=code_block_3.out10, value=code_block_3.out11)

# group: Set Appears in sheet list
# note: [0] - Off
# [1] - On
code_block_4 = CodeBlock { "Appears In Sheet List"; 1; }
setParameterByName_8 = Element.SetParameterByName(parameterName=code_block_4.out0, value=code_block_4.out1)  # frozen; unwired: element

# group: All Sheets
categories_2 = Categories("OST_Sheets")  # graph input
all_elements_of_category_2 = ElementsOfCategory(Category=categories_2)

code_block_5 = CodeBlock()
# ---------- code_block_5.designscript (24 lines) ----------
"Sheet Number";
"Sheet Name";
"!";
"Current Revision";
1;
"-000";
"_";
".pdf";
"Family";
"Issue - Draft Tender - 20/08/2021";
1;
"Issue - Prelim Ph 2+3 - 15/11/2021";
"Issue - Tender Ph 2+3 - 6/12/2021";
"Issue - Prelim Ph 4+5 - 19/11/2021";
"Issue - Tender - 03/01/2022";
"Issue - MCE Early Package - 10/11/2021";
"Issue - MCE Early Package - 15/11/2021";
"Issue - Prelim Ph 2+3 - 30/11/2021";
"Issue - Draft 80% Ph4+5 - 24/01/2022";
"Issue - Tender Ph 2+3 (excl Elec) - 31/01/2022";
"Issue - Prelim Ph 4+5 - 14/02/2022";
"Issue - Tender Ph 2+3 (Elec) - 07/02/2022";
"Issue - Prelim Ph 4+5 - 14/02/2022";
"Issue - Tender - 01/03/2022";
# ----------------------------------------

# group: Filter List to current issue list
getParameterValueByName_2 = Element.GetParameterValueByName(element=all_elements_of_category_2, parameterName=code_block_5.out22)
eq = getParameterValueByName_2 == code_block_5.out10
filterByBoolMask_2 = List.FilterByBoolMask(list=all_elements_of_category_2, mask=eq)

# group: Filter out cover sheet with !
relay = Relay(filterByBoolMask_2.in)
getParameterValueByName_3 = Element.GetParameterValueByName(element=relay, parameterName=code_block_5.out0)
string_from_object = FromObject(obj=getParameterValueByName_3)
contains_2 = String.Contains(str=string_from_object, searchFor=code_block_5.out2)
filterByBoolMask_3 = List.FilterByBoolMask(list=relay, mask=contains_2)

watch = Watch(filterByBoolMask_3.out)

# group: Set Sheet issue date + Aconex - Revision Date
relay_2 = Relay(watch)
# note: [0] - Off
# [1] - On
code_block_6 = CodeBlock { "Sheet Issue Date"; "06/09/21"; "Aconex - Revision Date"; "Current Revision Date"; "/22"; "/2022"; "1 - Date"; }
getParameterValueByName_4 = Element.GetParameterValueByName(element=relay_2, parameterName=code_block_6.out3)
replace = String.Replace(str=getParameterValueByName_4, searchFor=code_block_6.out4, replaceWith=code_block_6.out5)
setParameterByName_9 = Element.SetParameterByName(element=relay_2, parameterName=code_block_6.out0, value=replace)
setParameterByName_10 = Element.SetParameterByName(element=relay_2, parameterName=code_block_6.out2, value=replace)
setParameterByName_11 = Element.SetParameterByName(element=relay_2, parameterName=code_block_6.out6, value=getParameterValueByName_4)  # frozen

# group: clear revision information
code_block_7 = CodeBlock()  # frozen
# ---------- code_block_7.designscript (14 lines) ----------
"1 - Approv.";
"";
"1 - Checked";
"";
"1 - Date";
"";
"1 - Description";
"";
"1 - Modeled By";
"";
"1 - Rev.";
"";
"ARUP_BDR_ISSUE";
"";
# ----------------------------------------
setParameterByName_12 = Element.SetParameterByName(parameterName=code_block_7.out0, value=code_block_7.out1)  # unwired: element
setParameterByName_13 = Element.SetParameterByName(element=setParameterByName_12, parameterName=code_block_7.out2, value=code_block_7.out3)
setParameterByName_14 = Element.SetParameterByName(element=setParameterByName_13, parameterName=code_block_7.out4, value=code_block_7.out5)
setParameterByName_15 = Element.SetParameterByName(element=setParameterByName_14, parameterName=code_block_7.out12, value=code_block_7.out13)
setParameterByName_16 = Element.SetParameterByName(element=setParameterByName_15, parameterName=code_block_7.out6, value=code_block_7.out7)
setParameterByName_17 = Element.SetParameterByName(element=setParameterByName_16, parameterName=code_block_7.out8, value=code_block_7.out9)
setParameterByName_18 = Element.SetParameterByName(element=setParameterByName_17, parameterName=code_block_7.out10, value=code_block_7.out11)

# group: Remove sheet revisions
select_revision_2 = RevitRevisions()  # nothing selected
boolean_2 = BoolSelector(true)
remove_revision_from_sheet = Custom[Remove Revision from Sheet](revision=select_revision_2, runIt=boolean_2)  # frozen; package archi-lab.net; This node will remove specified Revisions from a sheet.; unwired: sheet

# group: Set Sheet Revision
relay_3 = Relay(watch)
code_block_8 = CodeBlock { "Admin_Document_Revision"; "Current Revision"; ""; }
getParameterValueByName_5 = Element.GetParameterValueByName(element=relay_3, parameterName=code_block_8.out1)
setParameterByName_19 = Element.SetParameterByName(element=relay_3, parameterName=code_block_8.out0, value=getParameterValueByName_5)

# group: Aconex - File
relay_4 = Relay(watch)
code_block_9 = CodeBlock { "Aconex - File"; }
code_block_10 = CodeBlock { "Sheet Number"; "Current Revision"; "_"; ".pdf"; "SY6-2-DRG-"; }
count = List.Count(list=relay_4)
ofRepeatedItem = List.OfRepeatedItem(item=code_block_10.out4, amount=count)
getParameterValueByName_6 = Element.GetParameterValueByName(element=relay_4, parameterName=code_block_10.out0)
add = ofRepeatedItem + getParameterValueByName_6
ofRepeatedItem_2 = List.OfRepeatedItem(item=code_block_10.out2, amount=count)
add_2 = add + ofRepeatedItem_2
getParameterValueByName_7 = Element.GetParameterValueByName(element=relay_4, parameterName=code_block_10.out1)
add_3 = add_2 + getParameterValueByName_7
ofRepeatedItem_3 = List.OfRepeatedItem(item=code_block_10.out3, amount=count)
add_4 = add_3 + ofRepeatedItem_3
setParameterByName_20 = Element.SetParameterByName(element=relay_4, parameterName=code_block_9, value=add_4)

# group: Set Sheet Revision Description
relay_5 = Relay(watch)
code_block_11 = CodeBlock { "1 - Description"; "Current Revision Description"; ""; }  # frozen
getParameterValueByName_8 = Element.GetParameterValueByName(element=relay_5, parameterName=code_block_11.out1)
setParameterByName_21 = Element.SetParameterByName(element=relay_5, parameterName=code_block_11.out0, value=getParameterValueByName_8)

relay_6 = Relay(relay_5)

# group: Set Sheet Status
code_block_12 = CodeBlock { "Admin_Document_Suitability"; "Preliminary"; "For Tender"; }
setParameterByName_22 = Element.SetParameterByName(element=relay_6, parameterName=code_block_12.out0, value=code_block_12.out1)

# group: Aconex - Supersede, Print Size
relay_7 = Relay(watch)
code_block_13 = CodeBlock { "Aconex - Supersede"; ""; }
setParameterByName_23 = Element.SetParameterByName(element=relay_7, parameterName=code_block_13.out0, value=code_block_13.out1)
code_block_14 = CodeBlock { "Aconex - Print Size"; "A1"; }
setParameterByName_24 = Element.SetParameterByName(element=relay_7, parameterName=code_block_14.out0, value=code_block_14.out1)

# group: All Title Blocks
categories_3 = Categories("OST_TitleBlocks")  # graph input
all_elements_of_category_3 = ElementsOfCategory(Category=categories_3)

code_block_15 = CodeBlock()
# ---------- code_block_15.designscript (20 lines) ----------
"Sheet Number";
"Sheet Name";
"Family";
"-000.";
"-0";
"Current Revision Date";
"_";
".pdf";
"!";
"Cover Sheet Title";
1;
"Issue - Prelim Ph 2+3 - 25/10/2021";
"Issue - Tender Ph 2+3 - 29/11/2021";
"Issue - Prelim Ph 4+5 - 15/11/2021";
"Issue - Tender Ph 4+5 - 20/12/2021";
"Issue - Tender Ph 2+3 (excl Elec) - 31/01/2022";
"Sheet Issue Date";
"31/01/2022";
"07/02/2022";
"14/02/22";
# ----------------------------------------

# group: Filter List by sheet issue date
relay_8 = Relay(all_elements_of_category_3)
getParameterValueByName_9 = Element.GetParameterValueByName(element=relay_8, parameterName=code_block_15.out16)
eq_2 = getParameterValueByName_9 == code_block_15.out19
filterByBoolMask_4 = List.FilterByBoolMask(list=relay_8, mask=eq_2)

# group: Filter out cover sheet with !
relay_9 = Relay(filterByBoolMask_4.out)
getParameterValueByName_10 = Element.GetParameterValueByName(element=relay_9, parameterName=code_block_15.out0)
string_from_object_2 = FromObject(obj=getParameterValueByName_10)
contains_3 = String.Contains(str=string_from_object_2, searchFor=code_block_15.out8)
filterByBoolMask_5 = List.FilterByBoolMask(list=relay_9, mask=contains_3)

# group: Filter out cover sheet title
relay_10 = Relay(filterByBoolMask_5.out)
getParameterValueByName_11 = Element.GetParameterValueByName(element=relay_10, parameterName=code_block_15.out2)
string_from_object_3 = FromObject(obj=getParameterValueByName_11)
contains_4 = String.Contains(str=string_from_object_3, searchFor=code_block_15.out9)
filterByBoolMask_6 = List.FilterByBoolMask(list=relay_10, mask=contains_4)

relay_11 = Relay(filterByBoolMask_6.out)

# group: Set DIP Stamp
code_block_16 = CodeBlock { "Arup DIP Stamp"; 1; }
setParameterByName_25 = Element.SetParameterByName(element=relay_11, parameterName=code_block_16.out0, value=code_block_16.out1)

# group: Set Revision Lines
code_block_17 = CodeBlock { "Rev 1"; "Rev 2"; "Rev 3"; "Rev 4"; "Rev 5"; "Rev 6"; "Rev 7"; "Rev 8"; "Rev 9"; 1; 0; }  # frozen
setParameterByName_26 = Element.SetParameterByName(element=relay_11, parameterName=code_block_17.out0, value=code_block_17.out9)
setParameterByName_27 = Element.SetParameterByName(element=setParameterByName_26, parameterName=code_block_17.out1, value=code_block_17.out9)
setParameterByName_28 = Element.SetParameterByName(element=setParameterByName_27, parameterName=code_block_17.out2, value=code_block_17.out9)
setParameterByName_29 = Element.SetParameterByName(element=setParameterByName_28, parameterName=code_block_17.out3, value=code_block_17.out9)
setParameterByName_30 = Element.SetParameterByName(element=setParameterByName_29, parameterName=code_block_17.out4, value=code_block_17.out9)
setParameterByName_31 = Element.SetParameterByName(element=setParameterByName_30, parameterName=code_block_17.out5, value=code_block_17.out9)
setParameterByName_32 = Element.SetParameterByName(element=setParameterByName_31, parameterName=code_block_17.out6, value=code_block_17.out10)
setParameterByName_33 = Element.SetParameterByName(element=setParameterByName_32, parameterName=code_block_17.out7, value=code_block_17.out10)
setParameterByName_34 = Element.SetParameterByName(element=setParameterByName_33, parameterName=code_block_17.out8, value=code_block_17.out10)

relay_12 = Relay(relay_11)  # frozen

# group: Set Rev Boxes
code_block_18 = CodeBlock { "Rev Box 1"; "Rev Box 2"; "Rev Box 3"; 1; 0; }
setParameterByName_35 = Element.SetParameterByName(element=relay_12, parameterName=code_block_18.out1, value=code_block_18.out3)
setParameterByName_36 = Element.SetParameterByName(element=relay_12, parameterName=code_block_18.out0, value=code_block_18.out3)
setParameterByName_37 = Element.SetParameterByName(element=relay_12, parameterName=code_block_18.out2, value=code_block_18.out4)

# group: sheet Number contains 000 - remove cover sheet
relay_13 = Relay(relay_11)  # frozen
getParameterValueByName_12 = Element.GetParameterValueByName(element=relay_13, parameterName=code_block_15.out0)
string_from_object_4 = FromObject(obj=getParameterValueByName_12)
contains_5 = String.Contains(str=string_from_object_4, searchFor=code_block_15.out3)
filterByBoolMask_7 = List.FilterByBoolMask(list=relay_13, mask=contains_5)

# group: Key plan off
code_block_19 = CodeBlock { "Key Plan"; 0; }  # frozen
setParameterByName_38 = Element.SetParameterByName(element=filterByBoolMask_7.in, parameterName=code_block_19.out0, value=code_block_19.out1)

# group: sheet number contains -0 scalebar off
relay_14 = Relay(filterByBoolMask_7.out)  # frozen
getParameterValueByName_13 = Element.GetParameterValueByName(element=relay_14, parameterName=code_block_15.out0)
string_from_object_5 = FromObject(obj=getParameterValueByName_13)
contains_6 = String.Contains(str=string_from_object_5, searchFor=code_block_15.out4)
filterByBoolMask_8 = List.FilterByBoolMask(list=relay_14, mask=contains_6)

# group: scalebar off
code_block_20 = CodeBlock { "Scalebar on off"; 0; }
setParameterByName_39 = Element.SetParameterByName(element=filterByBoolMask_8.in, parameterName=code_block_20.out0, value=code_block_20.out1)

# group: scalebar on
code_block_21 = CodeBlock { "Scalebar on off"; 1; }
setParameterByName_40 = Element.SetParameterByName(element=filterByBoolMask_8.out, parameterName=code_block_21.out0, value=code_block_21.out1)

# group: sheet Number contains 000 - remove cover
relay_15 = Relay(filterByBoolMask_3.out)
getParameterValueByName_14 = Element.GetParameterValueByName(element=relay_15, parameterName=code_block_5.out0)
string_from_object_6 = FromObject(obj=getParameterValueByName_14)
contains_7 = String.Contains(str=string_from_object_6, searchFor=code_block_5.out5)
filterByBoolMask_9 = List.FilterByBoolMask(list=relay_15, mask=contains_7)

relay_16 = Relay(watch)

# group: Aconex - Type, Status, Created By
code_block_22 = CodeBlock { "Aconex - Type"; "Drawing"; }
setParameterByName_41 = Element.SetParameterByName(element=relay_16, parameterName=code_block_22.out0, value=code_block_22.out1)
code_block_23 = CodeBlock { "Aconex - Status"; "Preliminary"; "For Tender"; }
setParameterByName_42 = Element.SetParameterByName(element=relay_16, parameterName=code_block_23.out0, value=code_block_23.out1)
code_block_24 = CodeBlock { "Aconex - Created By"; "Arup"; }
setParameterByName_43 = Element.SetParameterByName(element=relay_16, parameterName=code_block_24.out0, value=code_block_24.out1)

relay_17 = Relay(watch)
relay_18 = Relay(relay_17)

# group: Aconex - Discipline
relay_19 = Relay(relay_18)
code_block_25 = CodeBlock()
# ---------- code_block_25.designscript (14 lines) ----------
"Aconex - Discipline";
"Mechanical";
"Admin_Document_Role";
"Mechanical Services";
"Electrical Services";
"Fire Services";
"Hydraulic";
"Communications";
"Security";
"Electrical";
"Telecommunications";
"Combined Services";
"Controls";
"Facility Control and Monitoring System";
# ----------------------------------------
getParameterValueByName_15 = Element.GetParameterValueByName(element=relay_19, parameterName=code_block_25.out2)
eq_3 = getParameterValueByName_15 == code_block_25.out3
filterByBoolMask_10 = List.FilterByBoolMask(list=relay_19, mask=eq_3)
setParameterByName_44 = Element.SetParameterByName(element=filterByBoolMask_10.in, parameterName=code_block_25.out0, value=code_block_25.out1)
eq_4 = getParameterValueByName_15 == code_block_25.out4
filterByBoolMask_11 = List.FilterByBoolMask(list=relay_19, mask=eq_4)
setParameterByName_45 = Element.SetParameterByName(element=filterByBoolMask_11.in, parameterName=code_block_25.out0, value=code_block_25.out9)
eq_5 = getParameterValueByName_15 == code_block_25.out5
filterByBoolMask_12 = List.FilterByBoolMask(list=relay_19, mask=eq_5)
setParameterByName_46 = Element.SetParameterByName(element=filterByBoolMask_12.in, parameterName=code_block_25.out0, value=code_block_25.out5)
eq_6 = getParameterValueByName_15 == code_block_25.out8
filterByBoolMask_13 = List.FilterByBoolMask(list=relay_19, mask=eq_6)
setParameterByName_47 = Element.SetParameterByName(element=filterByBoolMask_13.in, parameterName=code_block_25.out0, value=code_block_25.out8)
eq_7 = getParameterValueByName_15 == code_block_25.out7
filterByBoolMask_14 = List.FilterByBoolMask(list=relay_19, mask=eq_7)
setParameterByName_48 = Element.SetParameterByName(element=filterByBoolMask_14.in, parameterName=code_block_25.out0, value=code_block_25.out10)
eq_8 = getParameterValueByName_15 == code_block_25.out6
filterByBoolMask_15 = List.FilterByBoolMask(list=relay_19, mask=eq_8)
setParameterByName_49 = Element.SetParameterByName(element=filterByBoolMask_15.in, parameterName=code_block_25.out0, value=code_block_25.out6)
eq_9 = getParameterValueByName_15 == code_block_25.out11
filterByBoolMask_16 = List.FilterByBoolMask(list=relay_19, mask=eq_9)
setParameterByName_50 = Element.SetParameterByName(element=filterByBoolMask_16.in, parameterName=code_block_25.out0, value=code_block_25.out11)
eq_10 = getParameterValueByName_15 == code_block_25.out13
filterByBoolMask_17 = List.FilterByBoolMask(list=relay_19, mask=eq_10)
setParameterByName_51 = Element.SetParameterByName(element=filterByBoolMask_17.in, parameterName=code_block_25.out0, value=code_block_25.out12)

# group: Aconex - Phase
relay_20 = Relay(relay_16)  # frozen
code_block_26 = CodeBlock()
# ---------- code_block_26.designscript (8 lines) ----------
"Aconex - Phase";
"Not Phase specific";
"Phase 1";
"Phase 2";
"Phase 3";
"Phase 4";
"Phase 5";
"Phase 1, Phase 2, Phase 3, Phase 4, Phase 5";
# ----------------------------------------
setParameterByName_52 = Element.SetParameterByName(element=relay_20, parameterName=code_block_26.out0, value=code_block_26.out7)

# group: Aconex - Level
relay_21 = Relay(relay_18)
code_block_27 = CodeBlock { "Sheet Number"; ".0"; ".1"; ".2"; ".3"; "Ground Floor"; "Level 1"; "Roof"; "Project Wide"; "Aconex - Level"; }
getParameterValueByName_16 = Element.GetParameterValueByName(element=relay_21, parameterName=code_block_27.out0)
contains_8 = String.Contains(str=getParameterValueByName_16, searchFor=code_block_27.out1)
filterByBoolMask_18 = List.FilterByBoolMask(list=relay_21, mask=contains_8)
setParameterByName_53 = Element.SetParameterByName(element=filterByBoolMask_18.in, parameterName=code_block_27.out9, value=code_block_27.out5)
contains_9 = String.Contains(str=getParameterValueByName_16, searchFor=code_block_27.out2)
filterByBoolMask_19 = List.FilterByBoolMask(list=relay_21, mask=contains_9)
setParameterByName_54 = Element.SetParameterByName(element=filterByBoolMask_19.in, parameterName=code_block_27.out9, value=code_block_27.out6)
contains_10 = String.Contains(str=getParameterValueByName_16, searchFor=code_block_27.out3)
filterByBoolMask_20 = List.FilterByBoolMask(list=relay_21, mask=contains_10)
setParameterByName_55 = Element.SetParameterByName(element=filterByBoolMask_20.in, parameterName=code_block_27.out9, value=code_block_27.out7)
contains_11 = String.Contains(str=getParameterValueByName_16, searchFor=code_block_27.out4)
filterByBoolMask_21 = List.FilterByBoolMask(list=relay_21, mask=contains_11)
setParameterByName_56 = Element.SetParameterByName(element=filterByBoolMask_21.in, parameterName=code_block_27.out9, value=code_block_27.out8)

code_block_28 = CodeBlock { "Sheet Number"; "Sheet Name"; "Family"; "-000."; "-0"; "-3"; "-5"; "-6"; "-6"; "-0"; ".0"; ".1"; ".2"; }  # frozen

# group: sheet Number contains -0, - Not plan views key plan required
relay_22 = Relay(relay_11)
getParameterValueByName_17 = Element.GetParameterValueByName(element=relay_22, parameterName=code_block_28.out0)
string_from_object_7 = FromObject(obj=getParameterValueByName_17)
contains_12 = String.Contains(str=string_from_object_7, searchFor=code_block_28.out4)
filterByBoolMask_22 = List.FilterByBoolMask(list=relay_22, mask=contains_12)

# group: sheet Number contains -5, - Not plan views key plan required
contains_13 = String.Contains(str=string_from_object_7, searchFor=code_block_28.out6)  # frozen
filterByBoolMask_23 = List.FilterByBoolMask(list=relay_22, mask=contains_13)

# group: sheet Number contains -3, - Not plan views key plan required
contains_14 = String.Contains(str=string_from_object_7, searchFor=code_block_28.out5)  # frozen
filterByBoolMask_24 = List.FilterByBoolMask(list=relay_22, mask=contains_14)

# group: sheet Number contains -6 - Not plan views key plan required
contains_15 = String.Contains(str=string_from_object_7, searchFor=code_block_28.out7)  # frozen
filterByBoolMask_25 = List.FilterByBoolMask(list=relay_22, mask=contains_15)

# group: Set non Plan view key plan off
list_create_2 = List.Create(item0=filterByBoolMask_22.in, item1=filterByBoolMask_23.in, item2=filterByBoolMask_24.in, item3=filterByBoolMask_25.in)
code_block_29 = CodeBlock { "Key Plan"; 0; }
setParameterByName_57 = Element.SetParameterByName(element=list_create_2, parameterName=code_block_29.out0, value=code_block_29.out1)

code_block_30 = CodeBlock { "Sheet Number"; "Sheet Name"; "Family"; "-000."; "Zone A"; "Zone B"; "Zone E"; }

# group: Set Key plan Zone - if Sheet name contains Zone A
relay_23 = Relay(relay_11)  # frozen
getParameterValueByName_18 = Element.GetParameterValueByName(element=relay_23, parameterName=code_block_30.out1)
string_from_object_8 = FromObject(obj=getParameterValueByName_18)
contains_16 = String.Contains(str=string_from_object_8, searchFor=code_block_30.out4)
filterByBoolMask_26 = List.FilterByBoolMask(list=relay_23, mask=contains_16)

# group: Set Key plan Not A, B, E - must be Site
code_block_31 = CodeBlock { "Sheet Number"; "Sheet Name"; "Family"; "-000."; "Zone A"; "Zone B"; "Zone E"; }
getParameterValueByName_19 = Element.GetParameterValueByName(element=filterByBoolMask_26.out, parameterName=code_block_31.out1)
string_from_object_9 = FromObject(obj=getParameterValueByName_19)
contains_17 = String.Contains(str=string_from_object_9, searchFor=code_block_31.out5)
filterByBoolMask_27 = List.FilterByBoolMask(list=filterByBoolMask_26.out, mask=contains_17)

# group: Only site sheets
string_from_object_10 = FromObject(obj=filterByBoolMask_27.out)
contains_18 = String.Contains(str=string_from_object_10, searchFor=code_block_31.out6)
filterByBoolMask_28 = List.FilterByBoolMask(list=filterByBoolMask_27.out, mask=contains_18)

# group: Zone Site - Set all other Zones to off
code_block_32 = CodeBlock { "Key Plan - Zone A and D"; "Key Plan - Zone B and C"; "Key Plan - Zone E and F"; 0; 1; }
setParameterByName_58 = Element.SetParameterByName(element=filterByBoolMask_28.out, parameterName=code_block_32.out0, value=code_block_32.out3)
setParameterByName_59 = Element.SetParameterByName(element=setParameterByName_58, parameterName=code_block_32.out1, value=code_block_32.out3)
setParameterByName_60 = Element.SetParameterByName(element=setParameterByName_59, parameterName=code_block_32.out2, value=code_block_32.out3)

# group: Set Zone A
code_block_33 = CodeBlock { "Key Plan - Zone A and D"; "Key Plan - Zone B and C"; "Key Plan - Zone E and F"; 0; 1; }
setParameterByName_61 = Element.SetParameterByName(element=filterByBoolMask_26.in, parameterName=code_block_33.out0, value=code_block_33.out4)
setParameterByName_62 = Element.SetParameterByName(element=setParameterByName_61, parameterName=code_block_33.out1, value=code_block_33.out3)
setParameterByName_63 = Element.SetParameterByName(element=setParameterByName_62, parameterName=code_block_33.out2, value=code_block_33.out3)

# group: Set Key plan Zone - if Sheet name contains Zone B
contains_19 = String.Contains(str=string_from_object_8, searchFor=code_block_30.out5)
filterByBoolMask_29 = List.FilterByBoolMask(list=relay_23, mask=contains_19)

# group: Set Zone B
code_block_34 = CodeBlock { "Key Plan - Zone A and D"; "Key Plan - Zone B and C"; "Key Plan - Zone E and F"; 0; 1; }
setParameterByName_64 = Element.SetParameterByName(element=filterByBoolMask_29.in, parameterName=code_block_34.out1, value=code_block_34.out4)
setParameterByName_65 = Element.SetParameterByName(element=setParameterByName_64, parameterName=code_block_34.out0, value=code_block_34.out3)
setParameterByName_66 = Element.SetParameterByName(element=setParameterByName_65, parameterName=code_block_34.out2, value=code_block_34.out3)

# group: Set Key plan Zone - if Sheet name contains Zone E
contains_20 = String.Contains(str=string_from_object_8, searchFor=code_block_30.out6)
filterByBoolMask_30 = List.FilterByBoolMask(list=relay_23, mask=contains_20)

# group: Set Zone E
code_block_35 = CodeBlock { "Key Plan - Zone A and D"; "Key Plan - Zone B and C"; "Key Plan - Zone E and F"; 0; 1; }
setParameterByName_67 = Element.SetParameterByName(element=filterByBoolMask_30.in, parameterName=code_block_35.out2, value=code_block_35.out4)
setParameterByName_68 = Element.SetParameterByName(element=setParameterByName_67, parameterName=code_block_35.out1, value=code_block_35.out3)
setParameterByName_69 = Element.SetParameterByName(element=setParameterByName_68, parameterName=code_block_35.out0, value=code_block_35.out3)

relay_24 = Relay(filterByBoolMask_26.in)

# group: List Sheet names obtained
getParameterValueByName_20 = Element.GetParameterValueByName(element=filterByBoolMask_28.out, parameterName=code_block_30.out1)
watch_2 = Watch(getParameterValueByName_20)

# group: sheet Number contains .0 - Ground Level
relay_25 = Relay(relay_11)  # frozen
code_block_36 = CodeBlock { "Sheet Number"; ".0"; }
getParameterValueByName_21 = Element.GetParameterValueByName(element=relay_25, parameterName=code_block_36.out0)
string_from_object_11 = FromObject(obj=getParameterValueByName_21)
contains_21 = String.Contains(str=string_from_object_11, searchFor=code_block_36.out1)
filterByBoolMask_31 = List.FilterByBoolMask(list=relay_25, mask=contains_21)

# group: Key plan Level
code_block_37 = CodeBlock { "Key Plan - Ground Lv"; 1; 0; }
setParameterByName_70 = Element.SetParameterByName(element=filterByBoolMask_31.in, parameterName=code_block_37.out0, value=code_block_37.out1)
setParameterByName_71 = Element.SetParameterByName(element=filterByBoolMask_31.out, parameterName=code_block_37.out0, value=code_block_37.out2)

# group: View list of Sheet Numbers
getParameterValueByName_22 = Element.GetParameterValueByName(element=filterByBoolMask_31.in, parameterName=code_block_36.out0)
watch_3 = Watch(getParameterValueByName_22)

# group: Aconex - Phase
relay_26 = Relay(relay_16)
code_block_38 = CodeBlock()
# ---------- code_block_38.designscript (10 lines) ----------
"Aconex - Phase";
"Not Phase specific";
"Phase 1";
"Phase 2";
"Phase 3";
"Phase 4";
"Phase 5";
"Phase 1, Phase 2, Phase 3, Phase 4, Phase 5";
"Phase 2, Phase 3";
"Phase 4, Phase 5";
# ----------------------------------------
setParameterByName_72 = Element.SetParameterByName(element=relay_26, parameterName=code_block_38.out0, value=code_block_38.out9)
