# Dynamo graph 221026-ArrayGrills.dyn (Dynamo 2.12.1.8246)

# group: Input
select_the_line = DSModelElementSelection()  # 1 picked in the model; graph input
select_grille = DSModelElementSelection()  # 1 picked in the model

# group: Points and distance
curves = Element.Curves(element=select_the_line)
startPoint = Curve.StartPoint(curve=curves)
X = Point.X(point=startPoint)
endPoint = Curve.EndPoint(curve=curves)
X_2 = Point.X(point=endPoint)
x_dist = X - X_2
Y = Point.Y(point=startPoint)
Y_2 = Point.Y(point=endPoint)
y_dist = Y - Y_2

# group: Angle of Line
div = x_dist / y_dist
atan = Math.Atan(ratio=div)
div_2 = y_dist / x_dist
atan_2 = Math.Atan(ratio=div_2)
list_create = List.Create(item0=atan, item1=atan_2)
angle_of_line = Watch(list_create)

code_block = CodeBlock(b=select_grille) { a=b; }
code_block_2 = CodeBlock(b=code_block) { a=b; }
code_block_3 = CodeBlock(b=code_block_2) { a=b; }

# group: Input
number_number_of_lights_x_axis = DoubleInput(9)  # graph input
number_number_of_lights_y_axis = DoubleInput(7)  # graph input

# group: Spacing Calc
overall_x = Math.Abs(number=x_dist)
code_block_4 = CodeBlock(z=X, y=overall_x) { x=z+y; }
code_block_5 = CodeBlock(y=number_number_of_lights_x_axis) { x=y*2; }
step_x = overall_x / code_block_5
start_overall_step = CodeBlock(SPX=X, X=code_block_4, A=step_x) { SPX..X..A; }
flatten = List.Flatten(list=start_overall_step)
overall_y = Math.Abs(number=y_dist)
code_block_6 = CodeBlock(z=Y, y=overall_y) { x=z+y; }
code_block_7 = CodeBlock(y=number_number_of_lights_y_axis) { x=y*2; }
step_y = overall_y / code_block_7
start_overall_step_2 = CodeBlock(SPY=Y, Y=code_block_6, A=step_y) { SPY..Y..A; }
flatten_2 = List.Flatten(list=start_overall_step_2)

# group: Gets the "Offset" Height of the selected
code_block_8 = CodeBlock { "Offset from Host"; }
getParameterValueByName = Element.GetParameterValueByName(element=select_grille, parameterName=code_block_8)

# group: Points
code_block_9 = CodeBlock { 1.0; -1; 2; }
x_list_dropeverynthitem = List.DropEveryNthItem(list=flatten, n=code_block_9.out2, offset=code_block_9.out0)
y_list_dropeverynthitem = List.DropEveryNthItem(list=flatten_2, n=code_block_9.out2, offset=code_block_9.out0)
byCoordinates = Point.ByCoordinates(x=x_list_dropeverynthitem, y=y_list_dropeverynthitem, z=getParameterValueByName, lacing=CrossProduct)
pruneDuplicates = Point.PruneDuplicates(points=byCoordinates)

# group: Finds the Level
code_block_10 = CodeBlock { "Level"; }
getParameterValueByName_2 = Element.GetParameterValueByName(element=code_block, parameterName=code_block_10)

# group: Exploded Bakery node. Creates the family instance by Point & Level. (Level has been added to the normal Python Code within the standard Bakery node, hence the exploded view)
code_block_11 = CodeBlock(points=pruneDuplicates) { points: var[]..[]; }
code_block_12 = CodeBlock(unknownItem=code_block_11) { unknownItem; }
code_block_13 = CodeBlock(item=code_block_12) { DSCore.List.Flatten([item]); }
code_block_14 = CodeBlock(seq=code_block_13) { seq; }
elementType = Element.ElementType(element=code_block)
code_block_15 = CodeBlock(familyType=elementType) { familyType: var[]..[]; }
code_block_16 = CodeBlock(level=getParameterValueByName_2) { level: var[]..[]; }
python_script = Python(IN[0]=code_block_14, IN[1]=code_block_15, IN[2]=code_block_16)  # IronPython2
# ---------- python_script.python (34 lines) ----------
import clr
clr.AddReference('RevitAPI')
from Autodesk.Revit.DB import *

clr.AddReference("RevitNodes")
import Revit
clr.ImportExtensions(Revit.Elements)
clr.ImportExtensions(Revit.GeometryConversion)

clr.AddReference("RevitServices")
import RevitServices
from RevitServices.Persistence import DocumentManager
from RevitServices.Transactions import TransactionManager
from Autodesk.Revit.DB.Structure import *

doc = DocumentManager.Instance.CurrentDBDocument
points = UnwrapElement(IN[0])
famtype = UnwrapElement(IN[1])
lvl = UnwrapElement(IN[2])

elementlist = list()

ST = StructuralType.NonStructural

TransactionManager.Instance.EnsureInTransaction(doc)
# Make sure the familysymbol is active
if famtype.IsActive == False:
	famtype.Activate()
	doc.Regenerate()
for point in points:
	newobj = doc.Create.NewFamilyInstance(point.ToXyz(),famtype,lvl,ST)
	elementlist.append(newobj)
TransactionManager.Instance.TransactionTaskDone()
OUT = elementlist
# ----------------------------------------
code_block_17 = CodeBlock(familyInstance=python_script) { familyInstance; }

# group: Rotation
angle = CodeBlock { 0; }
setRotation = FamilyInstance.SetRotation(familyInstance=code_block_17, degree=angle)

# group: Element Tagging
current = Document.Current()
activeView = Document.ActiveView(document=current)
boolean = BoolSelector(true)
boolean_2 = BoolSelector(false)
code_block_18 = CodeBlock { "Middle"; "Top"; }
distance_from_middle_top_x_y = CodeBlock { 0; 250; }
byCoordinates_2 = Vector.ByCoordinates(x=distance_from_middle_top_x_y.out0, y=distance_from_middle_top_x_y.out1)
byElement = Tag.ByElement(view=activeView, element=setRotation, horizontal=boolean, addLeader=boolean_2, horizontalAlignment=code_block_18.out0, verticalAlignment=code_block_18.out1, offset=byCoordinates_2)

# group: Delete original grille family
delete = Element.Delete(element=code_block_3)
firstItem = List.FirstItem(list=byElement)
not_ = Not(x=firstItem)
isNull = Object.IsNull(object=not_)
function_apply = ApplyFunction(func=delete, arg1=isNull)
