# Dynamo graph 221117 - MSFT - Copy Filters and Overrides to View Template.dyn (Dynamo 2.12.1.8246)

# group: CONTROL
target_view_view_template = Views("AUS_70-Sh-E_Lighting_General_Layout PKG02")  # graph input
filter_names = StringInput("zLinkedGridsOff")  # graph input

target_view_view_template_2 = Views("AUS_70-Sh-E_Security_Layout")  # graph input

# group: DESIGN
donating_view_template = Views("AUS_10-Wo-C_Combined Services_Layout")  # graph input
filters = View.Filters(view=donating_view_template)
name = Element.Name(element=filters)
allIndicesOf = List.AllIndicesOf(list=name, item=filter_names)
flatten = List.Flatten(list=allIndicesOf)
getItemAtIndex = List.GetItemAtIndex(list=filters, index=flatten)
code_block = CodeBlock { ", "; }
split = String.Split(string=filter_names, separator0=code_block)

# group: TO REVIT
filterOverrides = View.FilterOverrides(view=donating_view_template, parameterFilter=getItemAtIndex)
boolean = BoolSelector(false)
setFilterOverrides = View.SetFilterOverrides(view=target_view_view_template_2, parameterFilter=getItemAtIndex, overrides=filterOverrides, hide=boolean)

code_block_2 = CodeBlock()
# ---------- code_block_2.designscript (22 lines) ----------
/*
NOTES

This script allows to apply a/multiple
existing Filter/Filters with its/their
Overrides to another View or View Template.
Filters to be copied must be in Current View
and selected by typing their names in the
input string (if multiple, separate
with ", ").

WRITTEN BY		-	Andrea Belleri
DYNAMO VERSION	-	2.0.3.0
PACKAGES		-	None
REVIT TEMPLATE	-	GLOBAL
LAST UPDATED	-	18-06-2020

FUTURE IMPROVEMENTS
- Transfer the Filters and Overrides
to multiple Views/View Templates?

*/;
# ----------------------------------------
target_view_view_template_3 = Views("AUS_70-Sh-F_Fire_Protection_Layout_PKG03")  # graph input
target_view_view_template_4 = Views("AUS_70-Sh-F_Fire_Protection_Layout_PKG03_Fallow")  # graph input
target_view_view_template_5 = Views("AUS_70-Sh-F_Fire_Protection_RCP")  # graph input
target_view_view_template_6 = Views("AUS_70-Sh-E_Security_Layout_K")  # graph input
setFilterOverrides_2 = View.SetFilterOverrides(view=target_view_view_template_6, overrides=filterOverrides, hide=boolean)  # unwired: parameterFilter
target_view_view_template_7 = Views("AUS_70-Sh-E_Security_Layout_Enlarged Plans")  # graph input
setFilterOverrides_3 = View.SetFilterOverrides(view=target_view_view_template_7, parameterFilter=getItemAtIndex, overrides=filterOverrides, hide=boolean)
target_view_view_template_8 = Views("AUS_70-Sh-E_Security_Layout_M")  # graph input
setFilterOverrides_4 = View.SetFilterOverrides(view=target_view_view_template_8, parameterFilter=getItemAtIndex, overrides=filterOverrides, hide=boolean)
target_view_view_template_9 = Views("AUS_70-Sh-E_Security_Passback")  # graph input
setFilterOverrides_5 = View.SetFilterOverrides(view=target_view_view_template_9, parameterFilter=getItemAtIndex, overrides=filterOverrides, hide=boolean)
target_view_view_template_10 = Views("AUS_70-Sh-E_Security_Phasing")  # graph input
setFilterOverrides_6 = View.SetFilterOverrides(view=target_view_view_template_10, parameterFilter=getItemAtIndex, overrides=filterOverrides, hide=boolean)
identity = Object.Identity()  # unwired: object
element_types = ElementTypes("ViewPlan")
all_elements_of_type = ElementsOfType(element_type=element_types)
string_from_object = FromObject(obj=all_elements_of_type)
code_block_3 = CodeBlock { "AUS_7"; }
contains = String.Contains(string=string_from_object, searchFor=code_block_3)
filterByBoolMask = List.FilterByBoolMask(list=all_elements_of_type, mask=contains)
flatten_2 = List.Flatten(list=filterByBoolMask.in)
id = Element.Id(element=filterByBoolMask.in)
type = Object.Type(object=all_elements_of_type)
string = StringInput("Revit.Elements.Views.FloorPlanView")
eq = type == string
filterByBoolMask_2 = List.FilterByBoolMask(list=all_elements_of_type, mask=eq)
isViewTemplate = View.IsViewTemplate(view=filterByBoolMask_2.in)
filterByBoolMask_3 = List.FilterByBoolMask(list=filterByBoolMask_2.in, mask=isViewTemplate)
watch = Watch(filterByBoolMask_3.in)
sortByKey = List.SortByKey(list=filterByBoolMask.in)  # unwired: keys
