# Dynamo graph 221206 - Imported Categories.dyn (Dynamo 2.12.1.8246)
# packages: archi-lab.net 2023.213.1722

current = Document.Current()
activeView = Document.ActiveView(document=current)
setImportsInFamiliesVisibility = archilab.Revit.Views.Views.SetImportsInFamiliesVisibility(view=activeView)
watch = Watch(setImportsInFamiliesVisibility)
getImportedCategories = archilab.Revit.Views.Views.GetImportedCategories(view=activeView)
boolean = BoolSelector(false)
setImportedCategoriesVisibility = archilab.Revit.Views.Views.SetImportedCategoriesVisibility(view=activeView, category=getImportedCategories.DWG, visible=boolean)
watch_2 = Watch(setImportedCategoriesVisibility)
