# Dynamo graph 230202 - RenameFamilyTypes.dyn (Dynamo 2.6.2.15705)
# packages: Clockwork for Dynamo 2.x 2.4.0

join = String.Join()  # unwired: separator, string0
categories = Categories("OST_MechanicalEquipment")
all_family_types_of_category = Custom[All Family Types Of Category](category=categories)  # package Clockwork for Dynamo 2.x; Gets all family types/symbols of a given category in the model.
name = Element.Name(element=all_family_types_of_category)
code_block = CodeBlock()
# ---------- code_block.designscript (13 lines) ----------
"mm," + " x ";
"" + ",x";
"mm";
"";
" x ";
"x";
"  ";
" ";
"W 600 x H 1300";
"600x1300 WxH";
a="250";
"D" + a + " L" + a + "";
a + "x" + a + " ØxL";
# ----------------------------------------
replace = String.Replace(str=name, searchFor=code_block.out8, replaceWith=code_block.out9)
watch = Watch(replace)
