# Dynamo graph 230210 - UpdateScheduleHeaders.dyn (Dynamo 2.12.1.8246)
# packages: archi-lab.net 2023.213.1722

# group: Collecting The Schedule Views
view_type = ViewTypesUi("Schedule")
getByType = archilab.Revit.Views.Views.GetByType(viewType=view_type)
code_block = CodeBlock { "View Name"; "Scheduled fields"; "Fields"; "View Type"; "Wo-E"; }
getParameterValueByName = Element.GetParameterValueByName(element=getByType, parameterName=code_block.out0)
watch = Watch(getParameterValueByName)

# group: Schedule Text to Upper
columnHeadingToUpper = Python(IN[0]=getByType)  # CPython3
# ---------- columnHeadingToUpper.python (32 lines) ----------
import clr
clr.AddReference('ProtoGeometry')
from Autodesk.DesignScript.Geometry import *

#import Revit API
clr.AddReference('RevitAPI')
import Autodesk
from Autodesk.Revit.DB import *

clr.AddReference('RevitServices')
import RevitServices
from RevitServices.Persistence import DocumentManager
from RevitServices.Transactions import TransactionManager
doc = DocumentManager.Instance.CurrentDBDocument
columnHeading = []


toList = lambda x : x if hasattr(x, "__iter__") else [ x ]
viewsSchedule = toList(UnwrapElement(IN[0]))

TransactionManager.Instance.EnsureInTransaction(doc)
for view in viewsSchedule:
    if view.ViewType == ViewType.Schedule:
        scheduleDef = view.Definition
        fieldIds = scheduleDef.GetFieldOrder()
        for fieldId in fieldIds:
            scheduleField = scheduleDef.GetField(fieldId)
            scheduleField.ColumnHeading = scheduleField.ColumnHeading.upper()
            columnHeading.append(scheduleField.ColumnHeading)
TransactionManager.Instance.TransactionTaskDone()	

OUT = columnHeading
# ----------------------------------------
watch_2 = Watch(columnHeadingToUpper)
