# Dynamo graph Arup_ChangeFilledRegionLineStyle.dyn "FilledRegionLineStyle" (Dynamo 2.19.3.6394)
# packages: archi-lab.net 2025.300.1225, Genius Loci 2024.5.29

# group: Enter linestyle name as a string
code_block = CodeBlock { "Z_SketchLines"; }

# group: Get all linestyles and filter to chosen style
# Enter chosen linestyle name in code block below. Should be a string,
# note: This graph uses the following packages:
# •  archi-lab.net     2025.300.1225
# •  Genius Loci     2024.5.29
# •  DynamoIronPython2.7    2.4.0
element_classes = ElementTypes("GraphicsStyle")
all_elements_of_class = ElementsOfType(element_class=element_classes)
elementfilter_byname_equals = Custom[ElementFilter ByName Equals](element=all_elements_of_class, searchString=code_block)  # package Genius Loci; Filter elements by given name.

# group: Get filled regions of active view and change the border line style
get_filled_regions = Custom[Get Filled Regions]()  # package archi-lab.net; This node will query up all Filled Regions in the project as well as those in the active view only.
filledregion_linestyle_change = Custom[FilledRegion LineStyle Change](filledRegion=get_filled_regions.activeViewFilledRegions, lineStyle=elementfilter_byname_equals, lacing=Longest)  # package Genius Loci; Change the linestyle of the boundaries of a Filled Region to another given linestyle.

# group: Review name of chosen line type
# Just to check the filter worked as expected
code_block_2 = CodeBlock(a=elementfilter_byname_equals) { a.Name; }
