# Dynamo graph Arup_CopyTags_SelectedViews_FilterByCategory.dyn "RP_CopyTags_FilterByCategory" (Dynamo 2.19.3.6394)
# packages: spring nodes 210.1.1, Genius Loci 2024.5.29

# group: Refresh
# Connect or disconnect this node to "refresh" the Collect.CurrentSelection node.
# note: This graph uses the following packages:
# •  spring nodes 210.1.1
# •  Genius Loci 2024.5.29
# •  DynamoIronPython2.7
code_block = CodeBlock { true; }

# group: Set this to half of the total views
# to split the list into two lists of equal length
code_block_2 = CodeBlock { 3; }

# group: Select Views
# First node gets the views that are currently selected in the Project Browser. Second Node sorts the list. Third node splits the list into two (should be two equal lists, set the halfway point using the code block).
ꟿ_collect_currentselection = Custom[ꟿ Collect.CurrentSelection]()  # package spring nodes; Gets the currently selected elements. Connect a boolean switch to refresh the selection.
list_sortnatural = Custom[List SortNatural](list=ꟿ_collect_currentselection)  # package Genius Loci; Sorts a specified list in natural order in either ascending or descending order.
ꟿ_list_split = Custom[ꟿ List.Split](list=list_sortnatural, amount=code_block_2)  # package spring nodes; Splits a list at the desired length

# group: Choose category and finds all in views of first list
categories = Categories("OST_MEPSpaceTags")
all_elements_of_category_in_view = ElementsOfCategoryInView(Category=categories, View=ꟿ_list_split.list1)

# group: Copy elements from first list of views to second list of views
ꟿ_document_copyfromviewtoview = Custom[ꟿ Document.CopyFromViewToView](sourceView=ꟿ_list_split.list1, destView=ꟿ_list_split.list2, elements=all_elements_of_category_in_view)  # package spring nodes; The node will copy the input (view based) elements from the source view into the destination view.

# group: Change Family Type of copied elements (optional)
# Select new type from Family Types node.
code_block_3 = CodeBlock { "Type"; }
family_types = FamilyTypes("Arup_Tag_Space_Fire Alarm:Number and Name")
setParameterByName = Element.SetParameterByName(element=ꟿ_document_copyfromviewtoview, parameterName=code_block_3, value=family_types)
