# Dynamo graph ABG_190528_LearnDynamo2.dyn (Dynamo 2.16.2.5624)
# packages: Zebra 2016.7.2

# group: Not Equal / Equal
number = DoubleInput(5)
number_2 = DoubleInput(3)
ne = number != number_2
watch = Watch(ne)
number_3 = DoubleInput(3)
eq = number_2 == number_3
watch_2 = Watch(eq)

# group: Greater or Less than
number_4 = DoubleInput(5)
number_5 = DoubleInput(3)
gt = number_4 > number_5
watch_3 = Watch(gt)
lt = number_4 < number_5
watch_4 = Watch(lt)

# group: Greater/equal or Less/equal
number_6 = DoubleInput(5)
number_7 = DoubleInput(3)
ge = number_6 >= number_7
watch_5 = Watch(ge)
le = number_6 <= number_7
watch_6 = Watch(le)

# group: Operators
code_block = CodeBlock { placeholder; }  # unwired: placeholder

# group: Logic
code_block_2 = CodeBlock { placeholder; }  # unwired: placeholder

# group: True/false - Booleans
boolean = BoolSelector(true)
watch_7 = Watch(boolean)
boolean_2 = BoolSelector(false)
watch_8 = Watch(boolean_2)

# group: And (All must be true)
boolean_3 = BoolSelector(true)
boolean_4 = BoolSelector(true)
boolean_5 = BoolSelector(true)
and_ = And(bool0=boolean_3, bool1=boolean_4, bool2=boolean_5)
watch_9 = Watch(and_)

# group: Or (At least one true)
boolean_6 = BoolSelector(true)
boolean_7 = BoolSelector(true)
boolean_8 = BoolSelector(true)
or_ = Or(bool0=boolean_6, bool1=boolean_7, bool2=boolean_8)
watch_10 = Watch(or_)

# group: XOr (Only one is true)
boolean_9 = BoolSelector(true)
boolean_10 = BoolSelector(false)
xor = Math.Xor(bool=boolean_9, otherBool=boolean_10)
watch_11 = Watch(xor)

# group: Not (Opposite to input)
boolean_11 = BoolSelector(false)
not_ = Not(x=boolean_11)
watch_12 = Watch(not_)

# group: Convert between Units
number_8 = DoubleInput(191)
convert_between_units = DynamoConvert(number_8, MeasurementType="Length", FromConversion="Millimeters", ToConversion="Feet")
watch_13 = Watch(convert_between_units)
number_9 = DoubleInput(10000)
convert_between_units_2 = DynamoConvert(number_9, MeasurementType="Area", FromConversion="SquareMeter", ToConversion="Hectares")
watch_14 = Watch(convert_between_units_2)

# group: Convert Degrees <=> Radians
PI = Math.PI()
radiansToDegrees = Math.RadiansToDegrees(radians=PI)
watch_15 = Watch(radiansToDegrees)
number_10 = DoubleInput(180)
degreesToRadians = Math.DegreesToRadians(degrees=number_10)
watch_16 = Watch(degreesToRadians)

# group: Conversion
code_block_3 = CodeBlock { placeholder; }  # unwired: placeholder

# group: Ignore/Get Signs
number_11 = DoubleInput(-5.483)
abs = Math.Abs(number=number_11)
watch_17 = Watch(abs)
sign = Math.Sign(number=number_11)
watch_18 = Watch(sign)

# group: Number Range, Average Value
number_12 = DoubleInput(1)
number_13 = DoubleInput(9)
range = Range(start=number_12, end=number_13, step=number_12)
watch_19 = Watch(range)
average = Math.Average(numbers=watch_19)

# group: Number/Integer Sliders
integer_slider = IntegerSlider(4021, range=0..10000 step 1)
watch_20 = Watch(integer_slider)
number_slider = DoubleSlider(56.5, range=0..100 step 0.5)
watch_21 = Watch(number_slider)

# group: Sliders
code_block_4 = CodeBlock { placeholder; }  # unwired: placeholder

# group: Lists of Numbers
code_block_5 = CodeBlock { placeholder; }  # unwired: placeholder

# group: Round Up or Down
number_14 = DoubleInput(5.439)
ceiling = Math.Ceiling(number=number_14)
watch_22 = Watch(ceiling)
floor = Math.Floor(number=number_14)
watch_23 = Watch(floor)

# group: Round Nearest
number_15 = DoubleInput(5.867)
number_16 = DoubleInput(2)
round = Math.Round(number=number_15, digits=number_16)
watch_24 = Watch(round)
round_2 = Math.Round(number=number_15)
watch_25 = Watch(round_2)

# group: Rounding
code_block_6 = CodeBlock { placeholder; }  # unwired: placeholder

# group: Number Sequence, Remap Range
number_17 = DoubleInput(1)
number_18 = DoubleInput(9)
number_19 = DoubleInput(1)
sequence = Sequence(start=number_17, amount=number_18, step=number_19)
watch_26 = Watch(sequence)
number_20 = DoubleInput(0)
number_21 = DoubleInput(255)
remapRange = Math.RemapRange(numbers=watch_26, newMin=number_20, newMax=number_21)

# group: Sum
sum = Math.Sum(values=remapRange)
watch_27 = Watch(sum)

# group: Trigonometry
number_22 = DoubleInput(45)
cos = Math.Cos(angle=number_22)
watch_28 = Watch(cos)
sin = Math.Sin(angle=number_22)
watch_29 = Watch(sin)
tan = Math.Tan(angle=number_22)
watch_30 = Watch(tan)
number_23 = DoubleInput(0.5)
acos = Math.Acos(ratio=number_23)
watch_31 = Watch(acos)
asin = Math.Asin(ratio=number_23)
watch_32 = Watch(asin)
atan = Math.Atan(ratio=number_23)
watch_33 = Watch(atan)

# group: Operations
code_block_7 = CodeBlock { placeholder; }  # unwired: placeholder

# group: Exponential
number_24 = DoubleInput(5)
number_25 = DoubleInput(2)
pow = Math.Pow(number=number_24, power=number_25)
watch_34 = Watch(pow)
sqrt = Math.Sqrt(number=pow)
watch_35 = Watch(sqrt)

# group: Basic Operations
number_26 = DoubleInput(5)
number_27 = DoubleInput(3)
add = number_26 + number_27
watch_36 = Watch(add)
sub = number_27 - number_26
watch_37 = Watch(sub)
mul = number_26 * number_27
watch_38 = Watch(mul)
div = number_26 / number_27
watch_39 = Watch(div)
mod = number_26 % number_27
watch_40 = Watch(mod)

# group: Numbers!
number_28 = DoubleInput(5)

this_is_an_integer_and_a_number = DoubleInput(5)
this_is_not_an_integer_it_is_a = DoubleInput(5.483)  # "This is not an integer (it is a number)"
boolean_12 = BoolSelector(true)
number_29 = DoubleInput(5)
number_30 = DoubleInput(10)
if_ = Custom[Logic.If](test=boolean_12, ifTrue=number_29, ifFalse=number_30)  # package Zebra; Retains the old status of the previous built-in IF node.
