# Dynamo graph ABG_190531_LearnDynamo3.dyn (Dynamo 2.12.1.8246)

# group: Combining
code_block = CodeBlock { placeholder; }  # unwired: placeholder

# group: Strings!
string = StringInput("This is a string!")
string_2 = StringInput("String")
string_3 = StringInput("1")
string_4 = StringInput("1.542")

# group: Range/Sequence
string_5 = StringInput("A")
string_6 = StringInput("E")
number = DoubleInput(1)
range = Range(start=string_5, end=string_6, step=number)
watch = Watch(range)
string_7 = StringInput("A")
number_2 = DoubleInput(5)
number_3 = DoubleInput(1)
sequence = Sequence(start=string_7, amount=number_2, step=number_3)
watch_2 = Watch(sequence)

# group: Strings from other Data Types
code_block_2 = CodeBlock { 1..10..1; }
string_from_array = FromArray(arr=code_block_2)
watch_3 = Watch(string_from_array)
string_from_object = FromObject(obj=code_block_2)
watch_4 = Watch(string_from_object)

# group: Data Types
number_4 = DoubleInput(2)
mul = watch_4 * number_4
number_5 = DoubleInput(2)
mul_2 = code_block_2 * number_5

# group: To Strings
code_block_3 = CodeBlock { placeholder; }  # unwired: placeholder

# group: Concatenate/Join
string_8 = StringInput("Strings can also be")
string_9 = StringInput(" added using +")
add = string_8 + string_9
watch_5 = Watch(add)
string_10 = StringInput("Concatenate")
string_11 = StringInput("some")
string_12 = StringInput("strings!")
concat = String.Concat(string0=string_10, string1=string_11, string2=string_12)
watch_6 = Watch(concat)
string_13 = StringInput(",")
string_14 = StringInput("1")
string_15 = StringInput("2")
string_16 = StringInput("3")
join = String.Join(separator=string_13, string0=string_14, string1=string_15, string2=string_16)
watch_7 = Watch(join)

# group: Concatenate/Join Lists
code_block_4 = CodeBlock { "a".."z"..1; }
concat_2 = String.Concat(string0=code_block_4)
watch_8 = Watch(concat_2)
string_17 = StringInput(",")
join_2 = String.Join(separator=string_17, string0=code_block_4)
watch_9 = Watch(join_2)
string_18 = StringInput(",")
string_19 = StringInput("1")
code_block_5 = CodeBlock { 1..26..1; }
string_from_object_2 = FromObject(obj=code_block_5)
join_3 = String.Join(separator=string_18, string0=code_block_4, string1=string_19, string2=string_from_object_2)
watch_10 = Watch(join_3)

# group: Begin/End
string_20 = StringInput("Hello world")
string_21 = StringInput("World")
boolean = BoolSelector(true)
endsWith = String.EndsWith(string=string_20, searchFor=string_21, ignoreCase=boolean)
watch_11 = Watch(endsWith)
string_22 = StringInput("hello")
startsWith = String.StartsWith(string=string_20, searchFor=string_22, ignoreCase=boolean)
watch_12 = Watch(startsWith)

# group: Contains
string_23 = StringInput("John Smith")
string_24 = StringInput("Fred Smithson")
string_25 = StringInput("Joe Bloggs")
list_create = List.Create(item0=string_23, item1=string_24, item2=string_25)
string_26 = StringInput("Smith")
boolean_2 = BoolSelector(false)
contains = String.Contains(string=list_create, searchFor=string_26, ignoreCase=boolean_2)
watch_13 = Watch(contains)

# group: Logic
code_block_6 = CodeBlock { placeholder; }  # unwired: placeholder

# group: Exact Match
string_27 = StringInput("This")
eq = string_27 == string_27
watch_14 = Watch(eq)

toNumber = String.ToNumber(string=watch_4)

# group: Change Case
string_28 = StringInput("Gavin")
toLower = String.ToLower(string=string_28)
watch_15 = Watch(toLower)
toUpper = String.ToUpper(string=string_28)
watch_16 = Watch(toUpper)
boolean_3 = BoolSelector(false)
changeCase = String.ChangeCase(string=string_28, upper=boolean_3)
watch_17 = Watch(changeCase)

# group: Modifying
code_block_7 = CodeBlock { placeholder; }  # unwired: placeholder

# group: Inspecting
code_block_8 = CodeBlock { placeholder; }  # unwired: placeholder

string_29 = StringInput("en")

# group: All/First/Last Index
string_30 = StringInput("This is a sentence")
boolean_4 = BoolSelector(true)
allIndicesOf = String.AllIndicesOf(string=string_30, searchFor=string_29, ignoreCase=boolean_4)
watch_18 = Watch(allIndicesOf)
lastIndexOf = String.LastIndexOf(string=string_30, searchFor=string_29, ignoreCase=boolean_4)
watch_19 = Watch(lastIndexOf)
indexOf = String.IndexOf(string=string_30, searchFor=string_29, ignoreCase=boolean_4)
watch_20 = Watch(indexOf)

# group: Length/Count
string_31 = StringInput("This is my string")
length = String.Length(string=string_31)
watch_21 = Watch(length)
string_32 = StringInput("is")
boolean_5 = BoolSelector(true)
countOccurrences = String.CountOccurrences(string=string_31, searchFor=string_32, ignoreCase=boolean_5)
watch_22 = Watch(countOccurrences)

# group: Insert string
string_33 = StringInput("Superman    is better than batman")
string_34 = StringInput("is")
boolean_6 = BoolSelector(true)
indexOf_2 = String.IndexOf(string=string_33, searchFor=string_34, ignoreCase=boolean_6)
number_6 = DoubleInput(2)
add_2 = indexOf_2 + number_6
string_35 = StringInput("n't")
insert = String.Insert(string=string_33, index=add_2, toInsert=string_35)
watch_23 = Watch(insert)

# group: Padding
string_36 = StringInput("Surrounded")
number_7 = DoubleInput(16)
string_37 = StringInput("!")
center = String.Center(string=string_36, newLength=number_7, padChars=string_37)
watch_24 = Watch(center)
padLeft = String.PadLeft(string=string_36, newLength=number_7, padChars=string_37)
watch_25 = Watch(padLeft)
padRight = String.PadRight(string=string_36, newLength=number_7, padChars=string_37)
watch_26 = Watch(padRight)

# group: Searching and Separating
string_38 = StringInput("This is a sentence")
string_39 = StringInput(" ")
split = String.Split(string=string_38, separator0=string_39)
watch_27 = Watch(split)
string_40 = StringInput("Superman is so cool")
string_41 = StringInput("Superman")
string_42 = StringInput("Batman")
replace = String.Replace(string=string_40, searchFor=string_41, replaceWith=string_42)
watch_28 = Watch(replace)
number_8 = DoubleInput(0)
number_9 = DoubleInput(8)
remove = String.Remove(string=string_38, startIndex=number_8, count=number_9)
watch_29 = Watch(remove)
number_10 = DoubleInput(2)
substring = String.Substring(string=string_38, startIndex=number_10, length=number_10)
watch_30 = Watch(substring)

# group: Cleaning Strings
string_43 = StringInput("      1       this is a sentence         3   ")
trimLeadingWhitespace = String.TrimLeadingWhitespace(string=string_43)
watch_31 = Watch(trimLeadingWhitespace)
trimTrailingWhitespace = String.TrimTrailingWhitespace(string=string_43)
watch_32 = Watch(trimTrailingWhitespace)
trimWhitespace = String.TrimWhitespace(string=string_43)
watch_33 = Watch(trimWhitespace)

# group: Location (user defined)
number_11 = DoubleInput(45)
string_44 = StringInput("MadeUpTopia")
byLatitudeAndLongitude = DynamoUnits.Location.ByLatitudeAndLongitude(latitude=number_11, longitude=number_11, name=string_44)
name = DynamoUnits.Location.Name(location=byLatitudeAndLongitude)
watch_34 = Watch(name)
latitude = DynamoUnits.Location.Latitude(location=byLatitudeAndLongitude)
watch_35 = Watch(latitude)
longitude = DynamoUnits.Location.Longitude(location=byLatitudeAndLongitude)
watch_36 = Watch(longitude)

# group: Colour Ranges
color_range = ColorRange()  # unwired: colors, indices, value
byColorsAndParameters = ColorRange.ByColorsAndParameters()  # unwired: colors, parameters
getColorAtParameter = ColorRange.GetColorAtParameter(colorRange=byColorsAndParameters)  # unwired: parameter

# group: Mix/Create Colours
color_palette = ColorPalette({R: 35, G: 63, B: 133, A: 255})
number_12 = DoubleInput(2)
divide = Color.Divide(color=color_palette, dividend=number_12)
watch_37 = Watch(divide)
watch_38 = Watch(color_palette)
multiply = Color.Multiply(color=divide, multiplier=number_12)
watch_39 = Watch(multiply)
code_block_9 = CodeBlock { 50; 255; 0; }
byARGB = Color.ByARGB(alpha=code_block_9.out0, red=code_block_9.out1, green=code_block_9.out2, blue=code_block_9.out2)
byARGB_2 = Color.ByARGB(alpha=code_block_9.out0, red=code_block_9.out2, green=code_block_9.out2, blue=code_block_9.out1)
add_3 = Color.Add(color=byARGB, otherColor=byARGB_2)
watch_40 = Watch(add_3)

# group: Components
components = Color.Components(color=watch_40)
hue = Color.Hue(color=watch_40)
saturation = Color.Saturation(color=watch_40)
brightness = Color.Brightness(color=watch_40)
alpha = Color.Alpha(color=watch_40)
red = Color.Red(color=watch_40)
green = Color.Green(color=watch_40)
blue = Color.Blue(color=watch_40)

# group: Locations
code_block_10 = CodeBlock { placeholder; }  # unwired: placeholder

# group: Colours
code_block_11 = CodeBlock { placeholder; }  # unwired: placeholder

# group: Processing Dates
now = DateTime.Now()
watch_41 = Watch(now)
today = DateTime.Today()
watch_42 = Watch(today)
isDaylightSavingsTime = DateTime.IsDaylightSavingsTime(dateTime=today)
watch_43 = Watch(isDaylightSavingsTime)
dayOfWeek = DateTime.DayOfWeek(dateTime=today)
dayOfYear = DateTime.DayOfYear(dateTime=today)
date = DateTime.Date(dateTime=today)
components_2 = DateTime.Components(dateTime=today)

# group: Time
code_block_12 = CodeBlock { placeholder; }  # unwired: placeholder

# group: Lists of Letters
code_block_13 = CodeBlock { placeholder; }  # unwired: placeholder

watch_44 = Watch(code_block_13)
watch_45 = Watch()  # unwired: arg0
watch_46 = Watch(mul_2)
