# Dynamo graph ABG_190610_LearnDynamo6.dyn (Dynamo 2.19.3.6394)
# packages: Rhythm 2023.5.5

# group: Element Data
geometry = Element.Geometry()  # unwired: element
elementType = Element.ElementType()  # unwired: element
getCategory = Element.GetCategory()  # unwired: element
name = Element.Name()  # unwired: element

# group: Element Location
getLocation = Element.GetLocation()  # unwired: element
setLocation = Element.SetLocation()  # unwired: element, geometry

string = StringInput("Walls")  # frozen
byName = Category.ByName(name=string)
all_elements_of_category = ElementsOfCategory(Category=byName)
code_block = CodeBlock { "Wall Top RL"; }

# group: Get height
string_2 = StringInput("Base Constraint")
getParameterValueByName = Element.GetParameterValueByName(element=all_elements_of_category, parameterName=string_2)
elevation = Level.Elevation(level=getParameterValueByName)
string_3 = StringInput("Unconnected Height")
getParameterValueByName_2 = Element.GetParameterValueByName(element=all_elements_of_category, parameterName=string_3)
add = elevation + getParameterValueByName_2

setParameterByName = Element.SetParameterByName(element=all_elements_of_category, parameterName=code_block, value=add)  # frozen

# group: Element ID's
uniqueId = Element.UniqueId()  # unwired: element
id = Element.Id()  # unwired: element

# group: Parameters
parameters = Element.Parameters()  # unwired: element
parameterType = Parameter.ParameterType(parameter=parameters)
value = Parameter.Value(parameter=parameters)
isShared = Parameter.IsShared(parameter=parameters)

# group: Get Special
select_phase = RevitPhases("New Construction")
select_revision = RevitRevisions()  # nothing selected
levels = Levels("Origin_Project Datum")

# group: Rooms
isInsideRoom = Room.IsInsideRoom()  # unwired: room, point
setName = Room.SetName()  # unwired: room, value
setNumber = Room.SetNumber()  # unwired: room, value
name_2 = Room.Name()  # unwired: room
number = Room.Number()  # unwired: room

# group: Element Collectors
categories = Categories("OST_DuctCurves")
all_elements_of_category_2 = ElementsOfCategory(Category=categories)
family_types = FamilyTypes("Arup_Annotation_StartUp Page_Hyperlink Icon:03 - Useful Guidance Link Active")
all_elements_of_family_type = ElementsOfFamilyType(Family_Type=family_types)
element_types = ElementTypes("TextNoteType")
all_elements_of_type = ElementsOfType(element_type=element_types)
all_elements_in_active_view = ElementsInView()

# group: Collector (selection)
select_model_element = DSModelElementSelection()  # 1 picked in the model
select_model_elements = DSModelElementsSelection()  # 27 picked in the model

# group: Specify Element
views = Views("00 - PA - Project Setup - Floor Plan")
sheets = Sheets()  # nothing selected

sheetName = Sheet.SheetName(sheet=sheets)
sheetNumber = Sheet.SheetNumber(sheet=sheets)
family_types_2 = FamilyTypes("Arup_Basket_Bend Vertical Inside:BasketData")

# group: Active
current = Document.Current()
code_block_2 = CodeBlock(x=current) { x; }

# group: Family Instance
byCoordinates = FamilyInstance.ByCoordinates()  # unwired: familyType
byPoint = FamilyInstance.ByPoint()  # unwired: familyType, point
byFamilyType = FamilyInstance.ByFamilyType()  # unwired: familyType
setRotation = FamilyInstance.SetRotation()  # unwired: familyInstance, degree

watch = Watch(all_elements_of_category)
categories_2 = Categories("OST_PipeCurves")
all_elements_of_category_3 = ElementsOfCategory(Category=categories_2)
number_2 = Room.Number(room=all_elements_of_category_3)
levels_2 = Levels()  # nothing selected
all_elements_at_level = ElementsAtLevel(Level=levels_2)
getCategory_2 = Element.GetCategory(element=all_elements_at_level)
string_from_object = FromObject(obj=getCategory_2)
string_4 = StringInput("Walls")
eq = string_from_object == string_4
filterByBoolMask = List.FilterByBoolMask(list=all_elements_at_level, mask=eq)
parameters_2 = Element.Parameters(element=all_elements_of_category_3)
code_block_3 = CodeBlock { "Name"; }
name_3 = Room.Name(room=all_elements_of_category_3)
toUpper = String.ToUpper(string=name_3)
setParameterByName_2 = Element.SetParameterByName(element=all_elements_of_category_3, parameterName=code_block_3, value=toUpper)
