# Dynamo graph ABG_190612_LearnDynamo7-Read.dyn (Dynamo 2.19.3.6394)

code_block = CodeBlock()
# ---------- code_block.designscript (8 lines) ----------
"Name",
"Number",
"Unbounded height",
"Department",
"Base Finish",
"Ceiling Finish",
"Wall Finish",
"Floor Finish"];
# ----------------------------------------
file_path = Filename(".\ABG_200309_SharedParams2020a.xlsx")
code_block_2 = CodeBlock { "Sheet1"; 1; 1; "Some Cell Info"; true; }
exportExcel = Data.ExportExcel(filePath=file_path, sheetName=code_block_2.out0, startRow=code_block_2.out1, startColumn=code_block_2.out2, data=code_block_2.out3, overWrite=code_block_2.out4)
importExcel = Data.ImportExcel()  # unwired: file, sheetName
