# Dynamo graph ABG_190617_LearnDynamo8D2.dyn (Dynamo 2.19.3.6394)
# packages: Rhythm 2023.5.5, Clockwork for Dynamo 2.x 2.6.0, spring nodes 210.1.1

# group: Family/Type by name
string = StringInput("RPC Tree - Deciduous")
byName = Family.ByName(name=string)
string_2 = StringInput("Honey Locust - 25'")
byName_2 = FamilyType.ByName(name=string_2)

# group: And back...
name = Family.Name(family=byName)
name_2 = FamilyType.Name(familyType=byName_2)

# group: Family Types by Name
families = FamiliesDD(index=72)
string_3 = StringInput("Honey Locust - 25'")
byFamilyAndName = FamilyType.ByFamilyAndName(family=families, name=string_3)
string_4 = StringInput("RPC Tree - Deciduous")
byFamilyNameAndTypeName = FamilyType.ByFamilyNameAndTypeName(familyName=string_4, typeName=string_3)

# group: Element to Family
select_model_element = DSModelElementSelection()  # 1 picked in the model
geometry = Element.Geometry(element=select_model_element)
byUnion = Solid.ByUnion(solids=geometry)
code_block = CodeBlock { "Sample"; "Generic Models"; }
byName_3 = Category.ByName(name=code_block.out1)
file_path = Filename("L:\Revit\Templates\Revit 2019\Family Templates\Metric Generic Model.rft")
material = MaterialDD(index=31)
byGeometry = FamilyType.ByGeometry(solidGeometry=byUnion, name=code_block.out0, category=byName_3, templatePath=file_path, material=material)

# group: Family Types and Elements of Type
families_2 = FamiliesDD(index=72)
types = Family.Types(family=families_2)
family_types = FamilyTypes("Arup_DuctFitting_FibreCement_Rectangular_Branch_Square_Flanged:Generic")
all_elements_of_family_type = ElementsOfFamilyType(Family_Type=family_types)

# group: And back...
family = FamilyType.Family(familyType=types)

# group: Family Creation
byCoordinates = FamilyInstance.ByCoordinates()  # unwired: familyType
byFace = FamilyInstance.ByFace()  # unwired: familyType, face, line
byFace_2 = FamilyInstance.ByFace()  # unwired: familyType, face, location, referenceDirection
byPoint = FamilyInstance.ByPoint()  # unwired: familyType, point

# group: Example
byPointAndLevel = FamilyInstance.ByPointAndLevel()  # unwired: familyType, point, level
setRotation = FamilyInstance.SetRotation()  # unwired: familyInstance, degree

# group: All elements of Family Type
byFamilyType = FamilyInstance.ByFamilyType(familyType=byFamilyNameAndTypeName)

# group: Family Instance Properties
select_model_element_2 = DSModelElementSelection()  # 1 picked in the model
facingOrientation = FamilyInstance.FacingOrientation(familyInstance=select_model_element_2)
getHost = FamilyInstance.GetHost(familyInstance=select_model_element_2)
location = FamilyInstance.Location(familyInstance=select_model_element_2)

# group: Level Types
levels = Levels("Origin_Project Datum")
name_3 = Level.Name(level=levels)
elevation = Level.Elevation(level=levels)

# group: Structural Family Types
structural_column_types = StructuralColumnTypes()  # nothing selected
structural_framing_types = StructuralFramingTypes("Arup_Structural Framing_Family_Placeholder")

# group: System Families (NB Roof Types is from Rhythm)
wall_types = WallTypes()  # nothing selected
name_4 = WallType.Name(wallType=wall_types)
roof_types = RoofTypes()  # nothing selected
name_5 = RoofType.Name(roofType=roof_types)
floor_types = FloorTypes()  # nothing selected
name_6 = FloorType.Name(floorType=floor_types)

# group: Type by Name
byName_4 = WallType.ByName(name=name_4)
byName_5 = RoofType.ByName(name=name_5)
byName_6 = FloorType.ByName(name=name_6)

# group: Change Parameters
parameters = Element.Parameters(element=byName_4)
code_block_2 = CodeBlock { "Fire Rating"; "1-hr"; }
setParameterByName = Element.SetParameterByName(element=byName_4, parameterName=code_block_2.out0, value=code_block_2.out1)  # frozen

parameters_2 = Element.Parameters(element=levels)
categories = Categories("OST_FireProtectionHiddenLines")
boolean = BoolSelector(true)
current = Document.Current()

# group: Clockwork
all_families_of_category = Custom[All Families Of Category](category=categories, toggle=boolean, docOrRevitLinkInstance=current)  # package Clockwork for Dynamo 2.x; Gets all famiies of a given category in the model (does *not *work for system families)
all_family_types_of_category = Custom[All Family Types Of Category](category=categories, toggle=boolean, docOrRevitLinkInstance=current)  # package Clockwork for Dynamo 2.x; Gets all family types/symbols of a given category in the model.

watch = Watch(all_families_of_category)
watch_2 = Watch(all_family_types_of_category)
getLocation = Element.GetLocation(element=select_model_element_2)

# group: Same?
string_from_object = FromObject(obj=location)
string_from_object_2 = FromObject(obj=getLocation)
eq = string_from_object == string_from_object_2

watch_3 = Watch(eq)

# group: Create Walls
byCurveAndHeight = Wall.ByCurveAndHeight()  # unwired: curve, height, level, wallType
byCurveAndLevels = Wall.ByCurveAndLevels()  # unwired: curve, startLevel, endLevel, wallType

# group: Create Floors
byOutlineTypeAndLevel = Floor.ByOutlineTypeAndLevel()  # unwired: outlineCurves, floorType, level
byOutlineTypeAndLevel_2 = Floor.ByOutlineTypeAndLevel()  # unwired: outline, floorType, level

# group: Springs
elementSketch = Custom[Springs.Collector.ElementSketch]()  # package spring nodes; Get the actual sketch lines of a sketch based element (floor, ceiling, modified wall, etc.) . You can optionally fetch the matching model curves, however this might prove comptationally heavy on larger data sets. Does not work with elements from linked files.; unwired: element

# group: Create Roof
byOutlineTypeAndLevel_3 = Roof.ByOutlineTypeAndLevel()  # unwired: outline, roofType, level
byOutlineExtrusionTypeAndLevel = Roof.ByOutlineExtrusionTypeAndLevel()  # unwired: outline, roofType, level, plane, extrusionStart, extrusionEnd
