# Dynamo graph ABG_191024_OutletPlacement.dyn (Dynamo 2.19.3.6394)

clockwise = BoolSelector(true)  # graph input
select_room = DSModelElementSelection()  # 1 picked in the model; graph input
finishBoundary = Room.FinishBoundary(room=select_room)
byJoinedCurves = PolyCurve.ByJoinedCurves(curves=finishBoundary)
reverse = Curve.Reverse(curve=byJoinedCurves)
if_ = If(test=clockwise, true=reverse, false=byJoinedCurves)
offset_from_door = DoubleSlider(700, range=0..3000 step 100)  # graph input
length = Curve.Length(curve=if_)
select_door = DSModelElementSelection()  # 1 picked in the model; graph input
getLocation = Element.GetLocation(element=select_door)
closestPointTo = Geometry.ClosestPointTo(geometry=if_, other=getLocation)
parameterAtPoint = Curve.ParameterAtPoint(curve=if_, point=closestPointTo)
code_block = CodeBlock(offset_1=offset_from_door, length_1=length, pap_1=parameterAtPoint) { par_1 = offset_1/length_1; par_2 = pap_1+par_1; }
count = DoubleSlider(6, range=1..15 step 1)  # graph input
code_block_2 = CodeBlock(x=count) { seq_1 = 0..1..#x+1; seq_2 = DSCore.List.RemoveItemAtIndex(seq_1, x); }
add = code_block.par_2 + code_block_2.seq_2  # lacing=Longest
code_block_3 = CodeBlock(x=add) { x>=1; x-1; x; }
if_2 = If(test=code_block_3.out0, true=code_block_3.out1, false=code_block_3.x)
pointAtParameter = Curve.PointAtParameter(curve=if_, param=if_2, lacing=Longest)
normalAtParameter = Curve.NormalAtParameter(curve=if_, param=if_2, lacing=Longest)
reverse_2 = Vector.Reverse(vector=normalAtParameter)
if_3 = If(test=clockwise, true=reverse_2, false=normalAtParameter)
reverse_3 = Vector.Reverse(vector=if_3)  # frozen
code_block_4 = CodeBlock { 500; }
byStartPointDirectionLength = Line.ByStartPointDirectionLength(startPoint=pointAtParameter, direction=reverse_3, length=code_block_4, lacing=Longest)
family_to_place = FamilyTypes("Arup_Fan_Axial_AU:Exhaust Air D1000")  # graph input
host_level = Levels("0 DATUM")  # graph input
byPointAndLevel = FamilyInstance.ByPointAndLevel(familyType=family_to_place, point=pointAtParameter, level=host_level, lacing=Longest)
code_block_5 = CodeBlock(Vectors_1=if_3) { Vector.YAxis(); Vectors_1; Vector.ZAxis(); }
angleAboutAxis = Vector.AngleAboutAxis(vector=code_block_5.Vectors_1, otherVector=code_block_5.out0, rotationAxis=code_block_5.out2, lacing=Longest)
code_block_6 = CodeBlock { 3; }
round = Math.Round(number=angleAboutAxis, digits=code_block_6)
setRotation = FamilyInstance.SetRotation(familyInstance=byPointAndLevel, degree=round)
string = StringInput("CRN_Dim_MountingHeight1")
mounting_height = DoubleSlider(600, range=0..3000 step 50)  # graph input
setParameterByName = Element.SetParameterByName(element=byPointAndLevel, parameterName=string, value=mounting_height, lacing=Longest)
