# Dynamo graph DYN-ELT-MOD-001-AB_Create new Cable Tray Systems.dyn "DYN-ELT-MOD-001-AB_Create new Cable Tray System_List" (Dynamo 2.12.1.8246)
# packages: Clockwork for Dynamo 2.x 2.4.0

# group: TO REVIT - Parameters
# note: TO REVIT
# note: USE:
# FOR BLOCKS WHICH EXPORT INFORMATION
# TO REVIT

# group: INPUT
# note: INPUT
# note: USE:
# FOR INCOMING REFERENCES, WHICH ARE
# NOT USER DEFINED, SUCH AS FILE PATHS,
# GEOMETRIES, POINTS ETC.

# group: CONTROL
# note: USE:
# USER DEFINED INPUTS SUCH A NUMBER
# SLIDERS, STRINGS, KNOWN FILE PATHS
# ETC.
# note: CONTROL

# group: ANNOTATION
# note: ANNOTATION
# note: USE:
# FOR COMMENTS

# group: WIP
# note: WIP
# note: USE:
# FOR "WORK IN PROGRESS"

# group: TO SOFTWARE
# note: TO SOFTWARE
# note: USE:
# FOR BLOCKS WHICH EXPORT INFORMATION
# TO SOFTWARE OTHER THAN REVIT

# group: DESIGN
# note: USE:
# FOR THE BACK-END FUNCTIONALITY
# note: DESIGN

# group: MONITOR
# note: MONITOR
# note: USE:
# FOR IMPORTANT WATCH NODES

# group: TO REVIT - Create
# note: UNUSED
# note: USE:
# UNUSED

# group: UNUSED
# note: UNUSED
# note: USE:
# UNUSED

# group: UNUSED
# note: UNUSED
# note: USE:
# UNUSED

# group: UNUSED
# note: UNUSED
# note: USE:
# UNUSED

# group: Design - Look for existing Cable Tray Types and split names by "_"
categories = Categories("OST_CableTray")
all_family_types_of_category = Custom[All Family Types Of Category](category=categories)  # package Clockwork for Dynamo 2.x; Gets all family types/symbols of a given category in the model.
name = Element.Name(element=all_family_types_of_category)
code_block = CodeBlock { "_"; }
split = String.Split(string=name, separator0=code_block)
code_block_2 = CodeBlock { 1; }
getItemAtIndex = List.GetItemAtIndex(list=split@L2, index=code_block_2)

# group: INPUT - Name of the new Cable Tray System
# note: NOTE:
# This script works exclusively with GRS Naming convention for Cable Tray Types, i.e.
# Arup_Type_System
# (e.g. Arup_Tray_LV)
# Any deviation from this will cause the script to fail.
# For multiple input, please separate System names with a comma and no spaces.
string = StringInput("Arup_Basket_Test,Arup_Tray_Test1,Arup_Tray_AAA")  # graph input

code_block_3 = CodeBlock { ","; }
split_2 = String.Split(string=string, separator0=code_block_3)
flatten = List.Flatten(list=split_2)

# group: Design - Split name by "_"
code_block_4 = CodeBlock { "_"; }
split_3 = String.Split(string=flatten, separator0=code_block_4)
code_block_5 = CodeBlock { 1; }
getItemAtIndex_2 = List.GetItemAtIndex(list=split_3@L2, index=code_block_5)
code_block_6 = CodeBlock { 2; }
getItemAtIndex_3 = List.GetItemAtIndex(list=split_3@L2, index=code_block_6)
code_block_7 = CodeBlock { 0; }
getItemAtIndex_4 = List.GetItemAtIndex(list=split_3@L2, index=code_block_7)

# group: Design - Match new type with an existing one
# note: Example:
# Arup_Basket_LV  -->  Look for an existing "Basket"
# Arup_Tray_Comms --> Look for an existing "Tray"
allIndicesOf = List.AllIndicesOf(list=getItemAtIndex, item=getItemAtIndex_2)
firstItem = List.FirstItem(list=allIndicesOf@L2)
getItemAtIndex_5 = List.GetItemAtIndex(list=all_family_types_of_category, index=firstItem)

flatten_2 = List.Flatten(list=getItemAtIndex_5)

# group: To Revit - Duplicate Cable Tray Type
duplicate = Custom[FamilyType.Duplicate](elementType=flatten_2, name=flatten@L1)  # package Clockwork for Dynamo 2.x; Duplicates a family type

flatten_3 = List.Flatten(list=duplicate)
code_block_8 = CodeBlock { " "; }
list_create = List.Create(item0=getItemAtIndex_3, item1=getItemAtIndex_2)
transpose = List.Transpose(lists=list_create)
join = String.Join(separator=code_block_8, string0=transpose)
flatten_4 = List.Flatten(list=join)

# group: To Revit - Set Description
code_block_9 = CodeBlock { "Description"; }
setParameterByName = Element.SetParameterByName(element=flatten_3, parameterName=code_block_9, value=flatten_4)

# group: Design - Look for existing Bend Horizontal Fitting
code_block_10 = CodeBlock { "_"; }
code_block_11 = CodeBlock { "Bend Horizontal"; }

count = List.Count(list=flatten)
ofRepeatedItem = List.OfRepeatedItem(item=code_block_11, amount=count)
list_create_2 = List.Create(item0=getItemAtIndex_4, item1=getItemAtIndex_2, item2=ofRepeatedItem)
transpose_2 = List.Transpose(lists=list_create_2)

# group (continued): Design - Look for existing Bend Horizontal Fitting
join_2 = String.Join(separator=code_block_10, string0=transpose_2)
byName = Family.ByName(name=join_2)
types = Family.Types(family=byName)
firstItem_2 = List.FirstItem(list=types@L2)

# group: Design - Look for existing Bend Vertical Inside Fitting
code_block_12 = CodeBlock { "_"; }
code_block_13 = CodeBlock { "Bend Vertical Inside"; }

ofRepeatedItem_2 = List.OfRepeatedItem(item=code_block_13, amount=count)
list_create_3 = List.Create(item0=getItemAtIndex_4, item1=getItemAtIndex_2, item2=ofRepeatedItem_2)
transpose_3 = List.Transpose(lists=list_create_3)

# group (continued): Design - Look for existing Bend Vertical Inside Fitting
join_3 = String.Join(separator=code_block_12, string0=transpose_3)
byName_2 = Family.ByName(name=join_3)
types_2 = Family.Types(family=byName_2)
firstItem_3 = List.FirstItem(list=types_2)

# group: Design - Look for existing Bend Vertical Outside Fitting
code_block_14 = CodeBlock { "_"; }
code_block_15 = CodeBlock { "Bend Vertical Outside"; }

ofRepeatedItem_3 = List.OfRepeatedItem(item=code_block_15, amount=count)
list_create_4 = List.Create(item0=getItemAtIndex_4, item1=getItemAtIndex_2, item2=ofRepeatedItem_3)
transpose_4 = List.Transpose(lists=list_create_4)

# group (continued): Design - Look for existing Bend Vertical Outside Fitting
join_4 = String.Join(separator=code_block_14, string0=transpose_4)
byName_3 = Family.ByName(name=join_4)
types_3 = Family.Types(family=byName_3)
firstItem_4 = List.FirstItem(list=types_3)

# group: Design - Look for existing Tee Horizontal Fitting
code_block_16 = CodeBlock { "_"; }
code_block_17 = CodeBlock { "Tee Horizontal"; }

ofRepeatedItem_4 = List.OfRepeatedItem(item=code_block_17, amount=count)
list_create_5 = List.Create(item0=getItemAtIndex_4, item1=getItemAtIndex_2, item2=ofRepeatedItem_4)
transpose_5 = List.Transpose(lists=list_create_5)

# group (continued): Design - Look for existing Tee Horizontal Fitting
join_5 = String.Join(separator=code_block_16, string0=transpose_5)
byName_4 = Family.ByName(name=join_5)
types_4 = Family.Types(family=byName_4)
firstItem_5 = List.FirstItem(list=types_4)

# group: Design - Look for existing Cross Horizontal Fitting
code_block_18 = CodeBlock { "_"; }
code_block_19 = CodeBlock { "Cross Horizontal"; }

ofRepeatedItem_5 = List.OfRepeatedItem(item=code_block_19, amount=count)
list_create_6 = List.Create(item0=getItemAtIndex_4, item1=getItemAtIndex_2, item2=ofRepeatedItem_5)
transpose_6 = List.Transpose(lists=list_create_6)

# group (continued): Design - Look for existing Cross Horizontal Fitting
join_6 = String.Join(separator=code_block_18, string0=transpose_6)
byName_5 = Family.ByName(name=join_6)
types_5 = Family.Types(family=byName_5)
firstItem_6 = List.FirstItem(list=types_5)

# group: Design - Look for existing Reducer Fitting
code_block_20 = CodeBlock { "_"; }
code_block_21 = CodeBlock { "Reducer"; }

ofRepeatedItem_6 = List.OfRepeatedItem(item=code_block_21, amount=count)
list_create_7 = List.Create(item0=getItemAtIndex_4, item1=getItemAtIndex_2, item2=ofRepeatedItem_6)
transpose_7 = List.Transpose(lists=list_create_7)

# group (continued): Design - Look for existing Reducer Fitting
join_7 = String.Join(separator=code_block_20, string0=transpose_7)
byName_6 = Family.ByName(name=join_7)
types_6 = Family.Types(family=byName_6)
firstItem_7 = List.FirstItem(list=types_6)

# group: Design - Look for existing Union Fitting
code_block_22 = CodeBlock { "_"; }
code_block_23 = CodeBlock { "Union"; }

ofRepeatedItem_7 = List.OfRepeatedItem(item=code_block_23, amount=count)
list_create_8 = List.Create(item0=getItemAtIndex_4, item1=getItemAtIndex_2, item2=ofRepeatedItem_7)
transpose_8 = List.Transpose(lists=list_create_8)

# group (continued): Design - Look for existing Union Fitting
join_8 = String.Join(separator=code_block_22, string0=transpose_8)
byName_7 = Family.ByName(name=join_8)
types_7 = Family.Types(family=byName_7)
firstItem_8 = List.FirstItem(list=types_7)

# group: To Revit - Duplicate Cable Tray Fitting Types
duplicate_2 = Custom[FamilyType.Duplicate](elementType=firstItem_2, name=getItemAtIndex_3)
duplicate_3 = Custom[FamilyType.Duplicate](elementType=firstItem_3, name=getItemAtIndex_3)
duplicate_4 = Custom[FamilyType.Duplicate](elementType=firstItem_4, name=getItemAtIndex_3)
duplicate_5 = Custom[FamilyType.Duplicate](elementType=firstItem_5, name=getItemAtIndex_3)
duplicate_6 = Custom[FamilyType.Duplicate](elementType=firstItem_6, name=getItemAtIndex_3)
duplicate_7 = Custom[FamilyType.Duplicate](elementType=firstItem_7, name=getItemAtIndex_3)
duplicate_8 = Custom[FamilyType.Duplicate](elementType=firstItem_8, name=getItemAtIndex_3)

# group: To Revit - Set Fittings
code_block_24 = CodeBlock { "Horizontal Bend"; }
setParameterByName_2 = Element.SetParameterByName(element=duplicate, parameterName=code_block_24, value=duplicate_2)
code_block_25 = CodeBlock { "Vertical Inside Bend"; }
setParameterByName_3 = Element.SetParameterByName(element=duplicate, parameterName=code_block_25, value=duplicate_3)
code_block_26 = CodeBlock { "Vertical Outside Bend"; }
setParameterByName_4 = Element.SetParameterByName(element=duplicate, parameterName=code_block_26, value=duplicate_4)
code_block_27 = CodeBlock { "Tee"; }
setParameterByName_5 = Element.SetParameterByName(element=duplicate, parameterName=code_block_27, value=duplicate_5)
code_block_28 = CodeBlock { "Cross"; }
setParameterByName_6 = Element.SetParameterByName(element=duplicate, parameterName=code_block_28, value=duplicate_6)
code_block_29 = CodeBlock { "Transition"; }
setParameterByName_7 = Element.SetParameterByName(element=duplicate, parameterName=code_block_29, value=duplicate_7)
code_block_30 = CodeBlock { "Union"; }
setParameterByName_8 = Element.SetParameterByName(element=duplicate, parameterName=code_block_30, value=duplicate_8)

code_block_31 = CodeBlock()
# ---------- code_block_31.designscript (25 lines) ----------
/*
NOTES

This tool creates new Cable Tray systems.
In the GRS template CT systems are defined
by different Cable Tray Types, with specific
Cable Tray Fitting Types assigned to them
accordingly. This tool duplicates an existing
CT Type and all its CTF Types and rename them
to create a new system.
Please note that this script is based on the
GRS Naming Convention and deviating from it
will make the script fail.

WRITTEN BY		-	Andrea Belleri
DYNAMO VERSION	-	2.12.1
PACKAGES		-	Clockwork
REVIT TEMPLATE	-	AUS, RVT2022
LAST UPDATED	-	22-02-2023

FUTURE IMPROVEMENTS
- remove Naming Convention dependency
- option to import list of System from Excel
-
*/;
# ----------------------------------------
