# Dynamo graph Revit Create Section From Detail Line.dyn (Dynamo 2.12.1.8246)

# group: Inputs
select_model_elements = DSModelElementsSelection()  # 2 picked in the model; graph input
flip_section = BoolSelector(true)  # graph input
far_clip_offset = DoubleInput(3000)  # graph input
view_depth = DoubleInput(-200)  # graph input
view_height = DoubleInput(2000)  # graph input

# group: Filter for Detail lines
string_from_object = FromObject(object=select_model_elements)
code_block = CodeBlock { "DetailCurve"; }
contains = List.Contains(list=string_from_object, item=code_block, lacing=CrossProduct)
filterByBoolMask = List.FilterByBoolMask(list=select_model_elements, mask=contains)
geometry = Element.Geometry(element=filterByBoolMask.in)

section_angles = CodeBlock { -90; 90; }
if_ = If(test=flip_section, true=section_angles.out0, false=section_angles.out1)
count = List.Count(list=geometry)
cycle = List.Cycle(list=view_depth, amount=count, lacing=Longest)
flatten = List.Flatten(list=cycle)
cycle_2 = List.Cycle(list=view_height, amount=count, lacing=Longest)
create = List.Create(item0=flatten, item1=cycle_2)

# group: Sections from lines
code_block_2 = CodeBlock { 0.5; }
pointAtParameter = Curve.PointAtParameter(curve=geometry, param=code_block_2)
normalAtParameter = Curve.NormalAtParameter(curve=geometry, param=code_block_2)
code_block_3 = CodeBlock { Vector.ZAxis(); }
byOriginVectors = CoordinateSystem.ByOriginVectors(origin=pointAtParameter, xAxis=normalAtParameter, yAxis=code_block_3)
rotate = CoordinateSystem.Rotate(coordinateSystem=byOriginVectors, origin=pointAtParameter, axis=code_block_3, degrees=if_)
flatten_2 = List.Flatten(list=rotate)
length = Curve.Length(curve=geometry)
flatten_3 = List.Flatten(list=length)
code_block_4 = CodeBlock(b1=flatten_3, depth=far_clip_offset) { [-b1/2,b1/2]; [0,depth]; }
byCoordinates = Point.ByCoordinates(x=code_block_4.out0, y=create, z=code_block_4.out1, lacing=Longest)
code_block_5 = CodeBlock(p=byCoordinates) { p[0]; p[1]; }
byCoordinateSystemMinPointMaxPoint = SectionView.ByCoordinateSystemMinPointMaxPoint(cs=flatten_2, minPoint=code_block_5.out0, maxPoint=code_block_5.out1)

add_prefix_to_view_name = BoolSelector(true)
prefix = StringInput("10 - SH - SV")  # graph input

# group: Add prefix to view name
parameter = StringInput("View Name")
name = Element.Name(element=byCoordinateSystemMinPointMaxPoint)
concat = String.Concat(string0=prefix, string1=name)
if_2 = RefactoredIf(test=add_prefix_to_view_name, true=concat, false=name)

# group: Set View Name
setParameterByName = Element.SetParameterByName(element=byCoordinateSystemMinPointMaxPoint, parameterName=parameter, value=if_2)
