# Dynamo graph SSTOM_BW Penetration Placer_V1.dyn (Dynamo 2.12.1.8246)
# packages: spring nodes 210.1.1, Genius Loci 2023.7.13, Clockwork for Dynamo 2.x 2.4.0

# group: Builderswork Family
code_block = CodeBlock { "PLD_BUILDERS WORK OPENING_WALL_ROUND_AU"; "PLD_BUILDERS WORK OPENING_WALL_RECTANGULAR_AU"; }
byName = Family.ByName(name=code_block.out0)
types = Family.Types(family=byName)
byName_2 = Family.ByName(name=code_block.out1)
types_2 = Family.Types(family=byName_2)

code_block_2 = CodeBlock { "True"; }

# group: REFRESH TO START
REFRESH = BoolSelector(true)  # graph input

# group: User Selection
ꟿ_selectlinkedelementsinorder = Custom[ꟿ SelectLinkedElementsInOrder](dialog=code_block_2, refresh=REFRESH)  # package spring nodes; Select the linked instance first. Then select multiple elements from the Revit document in the desired order. Hit ESC to stop picking. To refresh the node, connect a boolean switch node.

# group: Filter only Pipes or Ducts
is_element_a_pipe_or_duct = Python(IN[0]=ꟿ_selectlinkedelementsinorder.elements)  # CPython3
# ---------- is_element_a_pipe_or_duct.python (56 lines) ----------
# Load the Python Standard and DesignScript Libraries
import sys
import clr
from Autodesk.DesignScript.Geometry import *
clr.AddReference('ProtoGeometry')
clr.AddReference("RevitAPI")
clr.AddReference("RevitAPIUI")
clr.AddReference("RevitServices")
import Autodesk.Revit.DB as DB
from RevitServices.Persistence import DocumentManager
from RevitServices.Transactions import TransactionManager
import Revit

# The inputs to this node will be stored as a list in the IN variables.
dataEnteringNode = IN

# Place your code below this line

# Start Revit document
doc = DocumentManager.Instance.CurrentDBDocument

# Unwrap elements from Dynamo inputs
elements = UnwrapElement(IN[0])

# Function to check if an element is a pipe or duct
def is_pipe_or_duct(element):
    if hasattr(element, "Category"):
        category = element.Category
        if category is not None:
            category_id = category.Id.IntegerValue
            if (category_id == DB.BuiltInCategory.OST_PipeCurves or
                category_id == DB.BuiltInCategory.OST_PipeInsulations or
                category_id == DB.BuiltInCategory.OST_DuctCurves or
                category_id == DB.BuiltInCategory.OST_DuctInsulations):
                return True
    return False

# Initialize an empty list to store the result
pipe_or_duct_list = []

# Start a transaction to access Revit API
doc = DocumentManager.Instance.CurrentDBDocument
TransactionManager.Instance.EnsureInTransaction(doc)

# Check each element in the input list
for element in elements:
    if is_pipe_or_duct(element):
        pipe_or_duct_list.append(True)
    else:
        pipe_or_duct_list.append(False)

# End the transaction
TransactionManager.Instance.TransactionTaskDone()

# Output the result
OUT = pipe_or_duct_list
# ----------------------------------------
filterByBoolMask = List.FilterByBoolMask(list=ꟿ_selectlinkedelementsinorder.elements, mask=is_element_a_pipe_or_duct)
# note: Does not include pipe insulation
sort_pipe_and_rect_into_two = Python(IN[0]=filterByBoolMask.in)  # "Sort Pipe and Rect into two lists [V3]"; CPython3
# ---------- sort_pipe_and_rect_into_two.python (64 lines) ----------
# Load the Python Standard and DesignScript Libraries
import sys
import clr
clr.AddReference('ProtoGeometry')
from Autodesk.DesignScript.Geometry import *
clr.AddReference('RevitAPI')
clr.AddReference('RevitAPIUI')
clr.AddReference('RevitNodes')
clr.AddReference('RevitServices')

import Autodesk
from Autodesk.Revit.DB import *
from Autodesk.Revit.UI import *
import RevitServices

from RevitServices.Persistence import DocumentManager
from RevitServices.Transactions import TransactionManager

clr.AddReference("RevitNodes")
import Revit
clr.ImportExtensions(Revit.Elements)
clr.ImportExtensions(Revit.GeometryConversion)

#elements = IN[0]
unwrapped = UnwrapElement(IN[0])

ductElements = []
pipe_insulation = []
duct_insulation = []
pipework_elements = []
elements_without_diameter =[]
filtered = []

def get_sorted_elements(element):
    # Get the lookup parameter value (use try-except to handle elements without the parameter)
    try:
        category = element.Category.Name
        if category == "Pipes":
            pipework_elements.append(element)
        elif category == "Pipe Insulations":
            pipe_insulation.append(element)
        elif category == "Ducts":
            # sort if rectangle or round
            if element.LookupParameter("Diameter"):
                pipework_elements.append(element)
            else:
                elements_without_diameter.append(element)
            # add duct insulation
        else:
            filtered.append(element)
    except:
        parameter_value = None

try:
    for element in unwrapped:
        # Get the category name for sorting
        inp = element.Category.Name
        get_sorted_elements(element)
except ValueError as e:
    # Handle the error (e.g., print an error message)
    print(str(e))

# Output the two lists of elements
OUT = pipework_elements, elements_without_diameter, pipe_insulation, duct_insulation, filtered
# ----------------------------------------

ꟿ_selectlinkedelement = Custom[ꟿ SelectLinkedElement](refresh=REFRESH)  # package spring nodes; Select the linked instance first, followed by the element. If your selection fails, just press escape. To refresh the node, connect a boolean switch node.

# group: Linked element geometry
geometry = Element.Geometry(element=ꟿ_selectlinkedelement.element)
identity = CoordinateSystem.Identity()
transform = Geometry.Transform(geometry=geometry, fromCoordinateSystem=identity, contextCoordinateSystem=ꟿ_selectlinkedelement.transform)

# group: Pipework
code_block_3 = CodeBlock { 0; }
getItemAtIndex = List.GetItemAtIndex(list=sort_pipe_and_rect_into_two, index=code_block_3)
geometry_2 = Element.Geometry(element=getItemAtIndex)
flatten = List.Flatten(list=geometry_2)
list_create = List.Create(item0=flatten)
intersect = Geometry.Intersect(geometry=list_create, other=transform)

# group: Pipes - Filter out empty
isEmpty = List.IsEmpty(list=intersect)
allTrue = List.AllTrue(list=isEmpty)
filterByBoolMask_2 = List.FilterByBoolMask(list=intersect, mask=allTrue)

# group: Get Pipe Level
code_block_4 = CodeBlock { "Reference Level"; }
getParameterValueByName = Element.GetParameterValueByName(element=getItemAtIndex, parameterName=code_block_4)
elevation = Level.Elevation(level=getParameterValueByName)

# group: Insert Circ. Peno family at Intersecting Point and Level
flatten_2 = List.Flatten(list=filterByBoolMask_2.out)
centroid = Solid.Centroid(solid=flatten_2)
# note: Geometry Z is total elevation above DATUM, minus the Project Z value to normalize
byPointAndLevel = FamilyInstance.ByPointAndLevel(familyType=types, point=centroid, level=getParameterValueByName, lacing=Longest)

# group: Get Pipe Diameter and Add BW diameter
code_block_5 = CodeBlock { 80; }
code_block_6 = CodeBlock { "Diameter"; }
getParameterValueByName_2 = Element.GetParameterValueByName(element=getItemAtIndex, parameterName=code_block_6)
add = code_block_5 + getParameterValueByName_2

# group: PIPES-Set Peno Size (Diameter)
code_block_7 = CodeBlock { "Asset_Dimensions_Overall_Diameter"; }
setParameterByName = Element.SetParameterByName(element=byPointAndLevel, parameterName=code_block_7, value=add)
getParameterValueByName_3 = Element.GetParameterValueByName(element=setParameterByName, parameterName=code_block_7)

# group: Get Wall Depth
code_block_8 = CodeBlock { "Volume"; "Area"; }
getParameterValueByName_4 = Element.GetParameterValueByName(element=ꟿ_selectlinkedelement.element, parameterName=code_block_8.out0)
getParameterValueByName_5 = Element.GetParameterValueByName(element=ꟿ_selectlinkedelement.element, parameterName=code_block_8.out1)
div = getParameterValueByName_4 / getParameterValueByName_5
convert_units = CodeBlock(x=div) { x*1000+10; }
round = Math.Round(number=convert_units)

# group: PIPES-Set Peno Depth
code_block_9 = CodeBlock { "Asset_Dimensions_Overall_Depth"; }
setParameterByName_2 = Element.SetParameterByName(element=byPointAndLevel, parameterName=code_block_9, value=round)
getParameterValueByName_6 = Element.GetParameterValueByName(element=setParameterByName_2, parameterName=code_block_9)

# group: PIPES-Fix Family Default Elevation Offset
code_block_10 = CodeBlock { "Elevation from Level"; }
# note: 2000 is the value set in Asset_Dimensions_Height_Mounting of the BW family
getParameterValueByName_7 = Element.GetParameterValueByName(element=byPointAndLevel, parameterName=code_block_10)
minus_offset_height = CodeBlock(x=getParameterValueByName_7, y=elevation) { x-y-2000; }
setParameterByName_3 = Element.SetParameterByName(element=byPointAndLevel, parameterName=code_block_10, value=minus_offset_height)

# group: Pipe Insulation
code_block_11 = CodeBlock { 2; }
getItemAtIndex_2 = List.GetItemAtIndex(list=sort_pipe_and_rect_into_two, index=code_block_11)
geometry_3 = Element.Geometry(element=getItemAtIndex_2)
flatten_3 = List.Flatten(list=geometry_3)
list_create_2 = List.Create(item0=flatten_3)
intersect_2 = Geometry.Intersect(geometry=list_create_2, other=transform)

# group: Pipes Insulation - Filter out empty
isEmpty_2 = List.IsEmpty(list=intersect_2)
allTrue_2 = List.AllTrue(list=isEmpty_2)
filterByBoolMask_3 = List.FilterByBoolMask(list=intersect_2, mask=allTrue_2)

# group: Get Pipe Insulation 'Pipe Size' and Add BW diameter
code_block_12 = CodeBlock { "Pipe Size"; "Insulation Thickness"; }
getParameterValueByName_8 = Element.GetParameterValueByName(element=getItemAtIndex_2, parameterName=code_block_12.out1)

# group: Pipe insulation diameter logic
# note: insulation size ignored if thicker then 40mm
# insulation becomes diameter
code_block_13 = CodeBlock { 40; }
gt = getParameterValueByName_8 > code_block_13
code_block_14 = CodeBlock { 80; }
# note: if less than 40, add 80mm to the diameter
add_2 = code_block_14 + getParameterValueByName_8
if_ = RefactoredIf(test=gt, true=getParameterValueByName_8, false=add_2)

# group: Rectangular geometry
code_block_15 = CodeBlock { 1; }
getItemAtIndex_3 = List.GetItemAtIndex(list=sort_pipe_and_rect_into_two, index=code_block_15)
geometry_4 = Element.Geometry(element=getItemAtIndex_3)

flatten_4 = List.Flatten(list=geometry_4)
list_create_3 = List.Create(item0=flatten_4)

# group (continued): Rectangular geometry
intersect_3 = Geometry.Intersect(geometry=list_create_3, other=transform)

# group: Ducts - Filter out empty
isEmpty_3 = List.IsEmpty(list=intersect_3)
allTrue_3 = List.AllTrue(list=isEmpty_3)
filterByBoolMask_4 = List.FilterByBoolMask(list=intersect_3, mask=allTrue_3)

# group: Get Duct Level
code_block_16 = CodeBlock { "Reference Level"; }
getParameterValueByName_9 = Element.GetParameterValueByName(element=getItemAtIndex_3, parameterName=code_block_16)
elevation_2 = Level.Elevation(level=getParameterValueByName_9)

# group: Insert Rect. Peno family at Intersecting Point and Level
flatten_5 = List.Flatten(list=filterByBoolMask_4.out)
centroid_2 = Solid.Centroid(solid=flatten_5)
byPointAndLevel_2 = FamilyInstance.ByPointAndLevel(familyType=types_2, point=centroid_2, level=getParameterValueByName_9, lacing=Longest)

# group: Get Duct (W*H) and Add BW Size
code_block_17 = CodeBlock { 100; }
code_block_18 = CodeBlock { "Width"; "Height"; }
getParameterValueByName_10 = Element.GetParameterValueByName(element=getItemAtIndex_3, parameterName=code_block_18.out0)
add_3 = code_block_17 + getParameterValueByName_10
getParameterValueByName_11 = Element.GetParameterValueByName(element=getItemAtIndex_3, parameterName=code_block_18.out1)
add_4 = code_block_17 + getParameterValueByName_11

# group: DUCTS-Set Peno Size (Width)
code_block_19 = CodeBlock { "Asset_Dimensions_Overall_Width"; }
setParameterByName_4 = Element.SetParameterByName(element=byPointAndLevel_2, parameterName=code_block_19, value=add_3)
getParameterValueByName_12 = Element.GetParameterValueByName(element=setParameterByName_4, parameterName=code_block_19)

# group: Get Pipe Insulation 'Pipe Size' and Add BW diameter
code_block_20 = CodeBlock { "Pipe Size"; "Insulation Thickness"; }
getParameterValueByName_13 = Element.GetParameterValueByName(element=getItemAtIndex_2, parameterName=code_block_20.out1)

# group: Pipe insulation diameter logic
# note: insulation size ignored if thicker then 40mm
# insulation becomes diameter
code_block_21 = CodeBlock { 40; }
gt_2 = getParameterValueByName_13 > code_block_21
code_block_22 = CodeBlock { 80; }
# note: if less than 40, add 80mm to the diameter
add_5 = code_block_22 + getParameterValueByName_13
if_2 = RefactoredIf(test=gt_2, true=getParameterValueByName_13, false=add_5)

# group: DUCTS-Set Peno Size (Height)
code_block_23 = CodeBlock { "Asset_Dimensions_Overall_Height"; }
setParameterByName_5 = Element.SetParameterByName(element=byPointAndLevel_2, parameterName=code_block_23, value=add_4)
getParameterValueByName_14 = Element.GetParameterValueByName(element=setParameterByName_5, parameterName=code_block_23)

# group: DUCTS-Fix Family Default Elevation Offset
code_block_24 = CodeBlock { "Elevation from Level"; }
Z = Point.Z(point=centroid_2)
# note: 2000 is the value set in Asset_Dimensions_Height_Mounting of the BW family
sub = Z - elevation_2
round_2 = Math.Round(number=sub)
minus_offset_height_2 = CodeBlock(x=round_2) { x-2000; }
setParameterByName_6 = Element.SetParameterByName(element=byPointAndLevel_2, parameterName=code_block_24, value=minus_offset_height_2)

# group: Insert Circ. Peno family at Intersecting Point and Level
flatten_6 = List.Flatten(list=filterByBoolMask_3.out)
centroid_3 = Solid.Centroid(solid=flatten_6)

# group: Get Pipe Insulation Level
activeViewFromCurrentDocument = Custom[Document.ActiveViewFromCurrentDocument]()  # package Clockwork for Dynamo 2.x; Gets the active view of the current document
view_level = Custom[View Level](view=activeViewFromCurrentDocument)  # package Genius Loci; Returns the level to which a view is associated.
Z_2 = Point.Z(point=centroid_3)
elevation_3 = Level.Elevation(level=view_level)
sub_2 = Z_2 - elevation_3
round_3 = Math.Round(number=sub_2)

# group (continued): Insert Circ. Peno family at Intersecting Point and Level
# note: Geometry Z is total elevation above DATUM, minus the Project Z value to normalize
byPointAndLevel_3 = FamilyInstance.ByPointAndLevel(familyType=types, point=centroid_3, level=view_level, lacing=Longest)

# group: PIPE INSULATION-Set Peno Size (Diameter)
code_block_25 = CodeBlock { "Asset_Dimensions_Overall_Diameter"; }
setParameterByName_7 = Element.SetParameterByName(element=byPointAndLevel_3, parameterName=code_block_25, value=if_)
getParameterValueByName_15 = Element.GetParameterValueByName(element=setParameterByName_7, parameterName=code_block_25)

# group: PIPE INSULATION-Fix Family Default Elevation Offset
code_block_26 = CodeBlock { "Elevation from Level"; }
# note: 2000 is the value set in Asset_Dimensions_Height_Mounting of the BW family
getParameterValueByName_16 = Element.GetParameterValueByName(element=byPointAndLevel_3, parameterName=code_block_26)
minus_offset_height_3 = CodeBlock(x=round_3) { x-2000; }
setParameterByName_8 = Element.SetParameterByName(element=byPointAndLevel_3, parameterName=code_block_26, value=minus_offset_height_3)

# group: PIPE INSULATION-Set Peno Depth
code_block_27 = CodeBlock { "Asset_Dimensions_Overall_Depth"; }
setParameterByName_9 = Element.SetParameterByName(element=byPointAndLevel_3, parameterName=code_block_27, value=round)
getParameterValueByName_17 = Element.GetParameterValueByName(element=setParameterByName_9, parameterName=code_block_27)
