# Dynamo graph SSTOM_ElementLevel_ReassignToClosest.dyn "SSTOM_ReassignToClosest Level" (Dynamo 2.12.1.8246)
# packages: Genius Loci 2023.7.13

select_model_elements = DSModelElementsSelection()  # 2 picked in the model; graph input

# group: Elements with 'Level' parameter
code_block = CodeBlock { "Level"; }
getParameterValueByName = Element.GetParameterValueByName(element=select_model_elements, parameterName=code_block)
code_block_2 = CodeBlock { ""; }
ne = getParameterValueByName != code_block_2
filterByBoolMask = List.FilterByBoolMask(list=select_model_elements, mask=ne)

code_block_3 = CodeBlock { "Level"; }
closest_level = Custom[Closest Level](element=select_model_elements)  # package Genius Loci; Return the closest level below the given element.
setParameterByName = Element.SetParameterByName(element=filterByBoolMask.in, parameterName=code_block_3, value=closest_level)

# group: Elements with 'Reference Level' parameter
code_block_4 = CodeBlock { "Reference Level"; }
getParameterValueByName_2 = Element.GetParameterValueByName(element=select_model_elements, parameterName=code_block_4)
code_block_5 = CodeBlock { ""; }
ne_2 = getParameterValueByName_2 != code_block_5
filterByBoolMask_2 = List.FilterByBoolMask(list=select_model_elements, mask=ne_2)

setParameterByName_2 = Element.SetParameterByName(element=filterByBoolMask_2.in, parameterName=code_block_4, value=closest_level)
getLocation = Element.GetLocation(element=setParameterByName_2)
list_create = List.Create(item0=setParameterByName, item1=getLocation)
firstItem = List.FirstItem(list=list_create)
list_create_2 = List.Create(item0=firstItem, item1=list_create)
flatten = List.Flatten(list=list_create_2)
getLocation_2 = Element.GetLocation(element=setParameterByName)
list_create_3 = List.Create(item0=getLocation_2, item1=getLocation)
firstItem_2 = List.FirstItem(list=list_create_3)
list_create_4 = List.Create(item0=firstItem_2, item1=list_create_3)
flatten_2 = List.Flatten(list=list_create_4)
setLocation = Element.SetLocation(element=flatten, geometry=flatten_2)
boolean = BoolSelector(true)
