# Dynamo graph SSTOM_LinkedModel_Wall_SectionView.dyn (Dynamo 2.12.1.8246)
# packages: spring nodes 210.1.1, archi-lab.net 2023.213.1722, EvolveLAB-Beaker 2.0.1

# group: Input
boolean = BoolSelector(true)
refresh_script = BoolSelector(false)  # graph input
ꟿ_selectlinkedelementsinorder = Custom[ꟿ SelectLinkedElementsInOrder](dialog=boolean, refresh=refresh_script)  # package spring nodes; Select the linked instance first. Then select multiple elements from the Revit document in the desired order. Hit ESC to stop picking. To refresh the node, connect a boolean switch node.
flip_section = BoolSelector(false)  # graph input

# group: Selection Filter for Wall (Category)
code_block = CodeBlock(list=ꟿ_selectlinkedelementsinorder.elements) { list; }
string_from_object = FromObject(object=code_block)
string_text_to_filter = StringInput("Wall")
contains = List.Contains(list=string_from_object, item=string_text_to_filter, lacing=Longest)
filterByBoolMask = List.FilterByBoolMask(list=code_block, mask=contains)

# group: Wall Curve
getLocation = Element.GetLocation(element=filterByBoolMask.in)

# group: Origin"
code_block_2 = CodeBlock { 0.5; }
pointAtParameter = Curve.PointAtParameter(curve=getLocation, param=code_block_2)

# group: X"
direction = Line.Direction(line=getLocation)
normalized = Vector.Normalized(vector=direction)

# group: Y"
ZAxis = Vector.ZAxis()

# group: Z"
cross = Vector.Cross(vector=normalized, cross=ZAxis)

# group: New CS
byOriginVectors = CoordinateSystem.ByOriginVectors(origin=pointAtParameter, xAxis=normalized, yAxis=ZAxis, zAxis=cross)

# group: Flips Section Orientation
code_block_3 = CodeBlock { Vector.ZAxis(); -180; 180; }
if_ = RefactoredIf(test=flip_section, true=code_block_3.out1, false=code_block_3.out2)
rotate = CoordinateSystem.Rotate(coordinateSystem=byOriginVectors, origin=pointAtParameter, axis=code_block_3.out0, degrees=if_)

# group: Wall Length, L
length = Curve.Length(curve=getLocation)

# group: Wall Depth, H
code_block_4 = CodeBlock(wallElements=filterByBoolMask.in) { wallElements; }
code_block_5 = CodeBlock { "Volume"; }
getParameterValueByName = Element.GetParameterValueByName(element=code_block_4, parameterName=code_block_5)
code_block_6 = CodeBlock { "Area"; }
getParameterValueByName_2 = Element.GetParameterValueByName(element=code_block_4, parameterName=code_block_6)

# group: Set back from center of wall Adds 10mm
code_block_7 = CodeBlock(a=getParameterValueByName, b=getParameterValueByName_2) { ((a/b*1000)/2)+10; }
code_block_8 = CodeBlock(x=code_block_7) { x[]; }
code_block_9 = CodeBlock(x=code_block_8) { x:int[]; -x; }

# group: MinPt
code_block_10 = CodeBlock(length=length) { -length/2; -150; }
byCoordinates = Point.ByCoordinates(x=code_block_10.out0, z=code_block_9.out1)

# group: Wall Height, H
code_block_11 = CodeBlock(wallElements=filterByBoolMask.in) { wallElements; }
code_block_12 = CodeBlock { "Unconnected Height"; }
getParameterValueByName_3 = Element.GetParameterValueByName(element=code_block_11, parameterName=code_block_12)

# group: MaxPt
code_block_13 = CodeBlock(length=length) { length/2; 150; }
byCoordinates_2 = Point.ByCoordinates(x=code_block_13.out0, y=getParameterValueByName_3, z=code_block_9.out0)

# group: Create Sections!
byCoordinateSystemMinPointMaxPoint = SectionView.ByCoordinateSystemMinPointMaxPoint(cs=rotate, minPoint=byCoordinates, maxPoint=byCoordinates_2)  # graph output

# group: Set Section View Template
view_templates = ViewTemplatesUi("70 - Sh - SV - BUILDERSWORK - Penetration - Section")
setViewTemplate = archilab.Revit.Views.Views.SetViewTemplate(view=byCoordinateSystemMinPointMaxPoint, viewTemplate=view_templates)

# group: Add prefix
parameter_name = StringInput("View Name")
view_name_prefix = StringInput("70 - SH - SV - ")  # graph input
getParameterValueByName_4 = Element.GetParameterValueByName(element=setViewTemplate, parameterName=parameter_name)
code_block_14 = CodeBlock(a=view_name_prefix, b=getParameterValueByName_4) { a+b; }
setParameterByName = Element.SetParameterByName(element=setViewTemplate, parameterName=parameter_name, value=code_block_14)  # graph output

# group: Ensure Section # continues, does not overwrite old sections
boolean_2 = BoolSelector(true)
bakeElements = Revit.Utilities.BakeElements(element=setParameterByName, bakeElementsToggle=boolean_2)
