# Dynamo graph SetCableTrayFittings.dyn (Dynamo 2.12.1.8246)
# packages: archi-lab.net 2023.213.1722

# group: Select Cable Tray With Run Fitting, (Duplicate and rename first)
select_model_element = DSModelElementSelection()  # 1 picked in the model; graph input

type = archilab.Revit.Elements.Elements.Type(element=select_model_element)
code_block = CodeBlock { "_"; }
select_family_tray_name = StringInput("Arup_Tray")  # graph input
code_block_2 = CodeBlock { "Bend Horizontal"; }
name = Element.Name(element=type)

# group: Bend Horizontal
join = String.Join(separator=code_block, string0=select_family_tray_name, string1=code_block_2)
byName = Family.ByName(name=join)
byFamilyAndName = FamilyType.ByFamilyAndName(family=byName, name=name)

code_block_3 = CodeBlock { "Bend Vertical Inside"; }

# group: Bend Vertical Inside
join_2 = String.Join(separator=code_block, string0=select_family_tray_name, string1=code_block_3)
byName_2 = Family.ByName(name=join_2)
byFamilyAndName_2 = FamilyType.ByFamilyAndName(family=byName_2, name=name)

code_block_4 = CodeBlock { "Bend Vertical Outside"; }

# group: Bend Vertical Inside
join_3 = String.Join(separator=code_block, string0=select_family_tray_name, string1=code_block_4)
byName_3 = Family.ByName(name=join_3)
byFamilyAndName_3 = FamilyType.ByFamilyAndName(family=byName_3, name=name)

code_block_5 = CodeBlock { "Tee Horizontal"; }

# group: Tee
join_4 = String.Join(separator=code_block, string0=select_family_tray_name, string1=code_block_5)
byName_4 = Family.ByName(name=join_4)
byFamilyAndName_4 = FamilyType.ByFamilyAndName(family=byName_4, name=name)

code_block_6 = CodeBlock { "Cross Horizontal"; }

# group: Cross Horizontal
join_5 = String.Join(separator=code_block, string0=select_family_tray_name, string1=code_block_6)
byName_5 = Family.ByName(name=join_5)
byFamilyAndName_5 = FamilyType.ByFamilyAndName(family=byName_5, name=name)

code_block_7 = CodeBlock { "Reducer"; }

# group: Cross Horizontal
join_6 = String.Join(separator=code_block, string0=select_family_tray_name, string1=code_block_7)
byName_6 = Family.ByName(name=join_6)
byFamilyAndName_6 = FamilyType.ByFamilyAndName(family=byName_6, name=name)

code_block_8 = CodeBlock { "Union"; }

# group: Union
join_7 = String.Join(separator=code_block, string0=select_family_tray_name, string1=code_block_8)
byName_7 = Family.ByName(name=join_7)
byFamilyAndName_7 = FamilyType.ByFamilyAndName(family=byName_7, name=name)

# group: Set parameters
code_block_9 = CodeBlock { "Horizontal Bend"; }
setParameterByName = Element.SetParameterByName(element=type, parameterName=code_block_9, value=byFamilyAndName)  # graph output
code_block_10 = CodeBlock { "Vertical Inside Bend"; }
setParameterByName_2 = Element.SetParameterByName(element=type, parameterName=code_block_10, value=byFamilyAndName_2)  # graph output
code_block_11 = CodeBlock { "Vertical Outside Bend"; }
setParameterByName_3 = Element.SetParameterByName(element=type, parameterName=code_block_11, value=byFamilyAndName_3)  # graph output
code_block_12 = CodeBlock { "Tee"; }
setParameterByName_4 = Element.SetParameterByName(element=type, parameterName=code_block_12, value=byFamilyAndName_4)  # graph output
code_block_13 = CodeBlock { "Cross"; }
setParameterByName_5 = Element.SetParameterByName(element=type, parameterName=code_block_13, value=byFamilyAndName_5)
code_block_14 = CodeBlock { "Transition"; }
setParameterByName_6 = Element.SetParameterByName(element=type, parameterName=code_block_14, value=byFamilyAndName_6)
code_block_15 = CodeBlock { "Union"; }
setParameterByName_7 = Element.SetParameterByName(element=type, parameterName=code_block_15, value=byFamilyAndName_7)
