# Dynamo graph SetConduitFittings.dyn (Dynamo 2.12.1.8246)
# packages: archi-lab.net 2023.213.1722

# group: Select Cable Tray With Run Fitting, (Duplicate and rename first)
select_model_elements = DSModelElementsSelection()  # 2 picked in the model; graph input

type = archilab.Revit.Elements.Elements.Type(element=select_model_elements)
code_block = CodeBlock { "_"; }
select_family_tray_name = StringInput("PLD")  # graph input
code_block_2 = CodeBlock { "CONDUIT FITTING ELBOW"; }
name = Element.Name(element=type)

# group: Elbow
join = String.Join(separator=code_block, string0=select_family_tray_name, string1=code_block_2)
byName = Family.ByName(name=join)
byFamilyAndName = FamilyType.ByFamilyAndName(family=byName, name=name)

code_block_3 = CodeBlock { "JUNCTION BOX_TEE"; }

# group: Tee
join_2 = String.Join(separator=code_block, string0=select_family_tray_name, string1=code_block_3)
byName_2 = Family.ByName(name=join_2)
byFamilyAndName_2 = FamilyType.ByFamilyAndName(family=byName_2, name=name)

code_block_4 = CodeBlock { "JUNCTION BOX_CROSS"; }

# group: Cross
join_3 = String.Join(separator=code_block, string0=select_family_tray_name, string1=code_block_4)
byName_3 = Family.ByName(name=join_3)
byFamilyAndName_3 = FamilyType.ByFamilyAndName(family=byName_3, name=name)

code_block_5 = CodeBlock { "JUNCTION BOX_TRANSITION"; }

# group: Transition
join_4 = String.Join(separator=code_block, string0=select_family_tray_name, string1=code_block_5)
byName_4 = Family.ByName(name=join_4)
byFamilyAndName_4 = FamilyType.ByFamilyAndName(family=byName_4, name=name)

code_block_6 = CodeBlock { "CONDUIT FITTING COUPLING"; }

# group: Union
join_5 = String.Join(separator=code_block, string0=select_family_tray_name, string1=code_block_6)
byName_5 = Family.ByName(name=join_5)
byFamilyAndName_5 = FamilyType.ByFamilyAndName(family=byName_5, name=name)

# group: Set parameters
code_block_7 = CodeBlock { "Bend"; }
setParameterByName = Element.SetParameterByName(element=type, parameterName=code_block_7, value=byFamilyAndName)  # graph output
code_block_8 = CodeBlock { "Tee"; }
setParameterByName_2 = Element.SetParameterByName(element=type, parameterName=code_block_8, value=byFamilyAndName_2)  # graph output
code_block_9 = CodeBlock { "Cross"; }
setParameterByName_3 = Element.SetParameterByName(element=type, parameterName=code_block_9, value=byFamilyAndName_3)
code_block_10 = CodeBlock { "Transition"; }
setParameterByName_4 = Element.SetParameterByName(element=type, parameterName=code_block_10, value=byFamilyAndName_4)
code_block_11 = CodeBlock { "Union"; }
setParameterByName_5 = Element.SetParameterByName(element=type, parameterName=code_block_11, value=byFamilyAndName_5)
