# Dynamo graph Transfer View Filters and Overrides - Dynamo.dyn (Dynamo 2.3.1.11775)

# group: Input
selected_view_template_index = CodeBlock { 276; }
do_filter_transfer = BoolSelector(true)  # graph input
selected_filter_indices = CodeBlock { 92..99; 92; 99; }

transfer_filters_and_overrides = Custom[Transfer Filters and Overrides](selected_view_template_index, do_filter_transfer, selected_filter_indices.out0)

# group: Available Selections
filters_available = Watch(transfer_filters_and_overrides.Available_Filters)
view_templates_available = Watch(transfer_filters_and_overrides.Available_View_Templates)

filters_selected = Watch(transfer_filters_and_overrides.Selected_Filters)
view_template_selected = Watch(transfer_filters_and_overrides.Selected_View_Template)
join = List.Join(list0=selected_filter_indices.out1, list1=selected_filter_indices.out2)
